# Grasshopper definition DevCheck2.gh (Grasshopper 1.0.8)
# plug-ins: Crane, Hagoromo, Weaverbird, NGon_RH8

mesh = Mesh(<mesh referenced from the Rhino model>)
crv = Curve([<curve referenced from the Rhino model> x18])
develop_mesh = DevelopMesh(Mesh=mesh)  # -> DevelopMesh, FaceTree
wbweave = WeaverbirdsMeshFromLinesWeaveBack(Lines=crv, MaximumValence=4)
meshnet6 = MeshNet6(TriangulatedMeshOrCutMesh=mesh)  # disabled
meshnet4 = MeshNet4(TriangulatedMeshOrCutMesh=mesh)

gcurvature = GaussianCurvature(TriangulatedMesh=mesh)
sort = SortList(Keys=gcurvature, ValuesA=gcurvature)  # -> Keys, ValuesA
avr = Average(Input=gcurvature)
item = ListItem(List=sort.ValuesA, Index=0, Wrap=True)  # -> Item1, Item
merge = Merge(Data1=item.Item1, Data2=item.Item, Data3=avr)
panel = Panel(merge)

crv_2 = Curve([<curve referenced from the Rhino model> x893])
opentreemesh = OpenTreeMesh(TriangulatedDevelopableMesh=wbweave)  # -> CutMesh, CutLines, MeshGraph
move = Move(Motion=Vector(0, 0, 10))  # -> Geometry, Transform
mbridgecm = MbridgeCM(TriangulatedMeshOrCutMesh=meshnet4)
wbweave_2 = WeaverbirdsMeshFromLinesWeaveBack(Lines=crv_2, MaximumValence=4)
meshnet4_2 = MeshNet4(TriangulatedMeshOrCutMesh=opentreemesh.CutMesh)
cutmeshedges = CutMeshEdges(TriangulatedCutMesh=opentreemesh.CutMesh)  # -> MeshAllEdges, MeshNakedEdges
meshedges = MeshEdges(Mesh=mbridgecm)  # -> AllE, NakedE
mesh_2 = Mesh(wbweave_2)
crv_3 = Curve(meshedges.NakedE)
len = Length(Curve=crv_3)
avr_2 = Average(Input=len)

# ----
# 曲率0に
cmesh_from_mesh = CMeshFromMesh(Mesh=wbweave_2)
developable = Developable()
static_solver = CraneStaticSolver(
    CMesh=cmesh_from_mesh,
    Constraints=developable,
    NRIteration=50,
    CGNRIteration=100,
    Threshold=1e-13,
    Solve=Toggle(True),
    IsRigidEdge=False,
    IsPanelFlat=True,
    IsFoldBlock=True,
    IsConstraint=True)  # -> CMesh, RigidOrigami, Residual
deconstruct_cmesh = DeconstructCMesh(CMesh=static_solver.CMesh)  # -> Mesh, Mountain, Valley, Boundary, Unassigned, Triangulate, Edges, Inner
develop_mesh_2 = DevelopMesh(Mesh=deconstruct_cmesh.Mesh)  # -> DevelopMesh, FaceTree
gcurvature_2 = GaussianCurvature(TriangulatedMesh=deconstruct_cmesh.Mesh)
sort_2 = SortList(Keys=gcurvature_2, ValuesA=gcurvature_2)  # -> Keys, ValuesA
avr_3 = Average(Input=gcurvature_2)
item_2 = ListItem(List=sort_2.ValuesA, Index=0, Wrap=True)  # -> Item1, Item
merge_2 = Merge(Data1=item_2.Item1, Data2=item_2.Item, Data3=avr_3)
panel_2 = Panel(merge_2)

crv_4 = Curve([<curve referenced from the Rhino model> x71])

develop3 = DevelopMesh3(TriangulatedMesh=wbweave_2, Count=Slider(1000, range=0..1000))  # -> ModifiedMesh, A
gcurvature_3 = GaussianCurvature(TriangulatedMesh=develop3.ModifiedMesh)
sort_3 = SortList(Keys=gcurvature_3, ValuesA=gcurvature_3)  # -> Keys, ValuesA
avr_4 = Average(Input=gcurvature_3)
item_3 = ListItem(List=sort_3.ValuesA, Index=0, Wrap=True)  # -> Item1, Item
merge_3 = Merge(Data1=item_3.Item1, Data2=item_3.Item, Data3=avr_4)
panel_3 = Panel(merge_3)

gcurvature_4 = GaussianCurvature(TriangulatedMesh=wbweave_2)
sort_4 = SortList(Keys=gcurvature_4, ValuesA=gcurvature_4)  # -> Keys, ValuesA
avr_5 = Average(Input=gcurvature_4)
item_4 = ListItem(List=sort_4.ValuesA, Index=0, Wrap=True)  # -> Item1, Item
merge_4 = Merge(Data1=item_4.Item1, Data2=item_4.Item, Data3=avr_5)
panel_4 = Panel(merge_4)

wbweave_3 = WeaverbirdsMeshFromLinesWeaveBack(Lines=crv_4, MaximumValence=4)
meshedges_2 = MeshEdges(Mesh=develop3.ModifiedMesh)  # -> AllE, NakedE
mbridgecm_2 = MbridgeCM(TriangulatedMeshOrCutMesh=wbweave_2)
mbridgecm_3 = MbridgeCM(TriangulatedMeshOrCutMesh=wbweave_3)
opentreemesh_2 = OpenTreeMesh(TriangulatedDevelopableMesh=wbweave_3)  # -> CutMesh, CutLines, MeshGraph
len_2 = Length(Curve=meshedges_2.NakedE)
avr_6 = Average(Input=len_2)
mbridgecm_4 = MbridgeCM(TriangulatedMeshOrCutMesh=opentreemesh_2.CutMesh)
developcm = DevelopCutMesh(TriangulatedCutMesh=mbridgecm_2, Count=Slider(1000, range=0..1000))
cutmeshedges_2 = CutMeshEdges(TriangulatedMeshOrCutMesh=opentreemesh_2.CutMesh)  # -> MeshAllEdges, MeshNakedEdges
cutmeshedges_3 = CutMeshEdges(TriangulatedMeshOrCutMesh=developcm)  # -> MeshAllEdges, MeshNakedEdges
crv_5 = Curve(cutmeshedges_2.MeshNakedEdges)
sortcutmesh = SortCutMesh(TriangulatedMeshOrCutMesh=develop3.ModifiedMesh)
meshnet6_2 = MeshNet6(TriangulatedMeshOrCutMesh=develop3.ModifiedMesh)
meshnet4_3 = MeshNet4(TriangulatedMeshOrCutMesh=develop3.ModifiedMesh)
cutmeshedges_4 = CutMeshEdges(TriangulatedMeshOrCutMesh=sortcutmesh)  # -> MeshAllEdges, MeshNakedEdges

# ----
# 展開図
develop_mesh_3 = DevelopMesh(Mesh=develop3.ModifiedMesh)  # -> DevelopMesh, FaceTree
meshedges_3 = MeshEdges(Mesh=develop_mesh_3.DevelopMesh)  # -> AllE, NakedE

mbridgecm_5 = MbridgeCM(TriangulatedMeshOrCutMesh=meshnet4_3)
cutmeshedges_5 = CutMeshEdges(TriangulatedMeshOrCutMesh=meshnet6_2)  # -> MeshAllEdges, MeshNakedEdges
meshedges_4 = MeshEdges(Mesh=mbridgecm_5)  # -> AllE, NakedE
len_3 = Length(Curve=cutmeshedges_4.MeshAllEdges)
len_4 = Length(Curve=cutmeshedges_5.MeshAllEdges)
len_5 = Length(Curve=meshedges_4.NakedE)
avr_7 = Average(Input=len_5)
cutmeshedges_6 = CutMeshEdges(TriangulatedMeshOrCutMesh=meshnet4_3)  # -> MeshAllEdges, MeshNakedEdges
subtraction = Subtraction(A=len_4, B=len_3)
abs = Absolute(Value=subtraction)
avr_8 = Average(Input=abs)
len_6 = Length(Curve=cutmeshedges_6.MeshAllEdges)
subtraction_2 = Subtraction(A=len_6, B=len_3)
abs_2 = Absolute(Value=subtraction_2)
panel_5 = Panel(avr_8)
avr_9 = Average(Input=abs_2)
panel_6 = Panel(avr_9)
