# Grasshopper definition innerCutDev.gh (Grasshopper 1.0.8)
# plug-ins: Heteroptera, Pufferfish, Hagoromo, Weaverbird, NGon_RH8

_10º = PowerOf10(Value=Slider(-3, range=-10..10))
_10º_2 = PowerOf10(Value=Slider(4, range=-10..10))
crv = Curve([<curve referenced from the Rhino model> x81])
crv_2 = Curve(<curve referenced from the Rhino model>)
number_slider = Slider(5000, range=0..10000)
project = Project(Geometry=crv, Plane=PlaneXY(0, 0, 0))  # -> Geometry, Transform
number_slider_2 = Slider(1000, range=0..1000)
len = Length(Curve=crv)
number_slider_3 = Slider(1, range=0..100)
wbweave = WeaverbirdsMeshFromLinesWeaveBack(Lines=project.Geometry, MaximumValence=4)
avr = Average(Input=len)
crv_3 = Curve(<curve referenced from the Rhino model>)
explode = Explode(Curve=crv_3, Recursive=True)  # -> Segments, Vertices
project_2 = Project(Geometry=crv_3, Plane=PlaneXY(0, 0, 0))  # -> Geometry, Transform
_10º_3 = PowerOf10(Value=Slider(3, range=0..10))
_10º_4 = PowerOf10(Value=Slider(-3, range=-3..10))
panel = Panel("""0
1
2
3
4""")
panel_2 = Panel("12")
item = ListItem(List=explode.Segments, Index=panel, Wrap=True)
wbweave_2 = WeaverbirdsMeshFromLinesWeaveBack(Lines=crv, MaximumValence=4)
mbridgecm = MbridgeCM(TriangulatedMeshOrCutMesh=wbweave_2)
sortcutmesh = SortCutMesh(TriangulatedMeshOrCutMesh=mbridgecm)
mbridgecm_2 = MbridgeCM(TriangulatedMeshOrCutMesh=wbweave_2)
meshcutbylines = MeshCutWithCutLines(TriangulatedMeshOrCutMesh=mbridgecm_2, OpenCutLinesPolylines=item)
meshcutbylines_2 = MeshCutWithCutLines(TriangulatedMeshOrCutMesh=meshcutbylines, OpenCutLinesPolylines=crv_2)
dividecutmesh = DivideCutMesh(TriangulatedMeshOrCutMesh=meshcutbylines_2)
item_2 = ListItem(List=dividecutmesh, Index="1", Wrap=True)
mbridgecm_3 = MbridgeCM(TriangulatedMeshOrCutMesh=item_2)
meshedges = MeshEdges(Mesh=mbridgecm_3)  # -> AllE, NakedE
sortcutmesh_2 = SortCutMesh(TriangulatedMeshOrCutMesh=meshcutbylines)
cutmeshedges = CutMeshEdges(TriangulatedMeshOrCutMesh=mbridgecm)  # -> MeshAllEdges, MeshNakedEdges
meshedges_2 = MeshEdges(Mesh=wbweave_2)  # -> AllE, NakedE
deccutmesh = DeconstructCutMesh(TriangulatedMeshOrCutMesh=sortcutmesh_2)  # -> Vertices, Faces, Edges
categorycheck = CategoryCheck(
    TriangulatedCutMesh=sortcutmesh_2,
    XyMirror=False,
    YzMirror=False,
    ZxMirror=False,
    OuterBoundaryCurves=cutmeshedges.MeshNakedEdges)
meshcutbylines_3 = MeshCutWithCutLines(TriangulatedMeshOrCutMesh=wbweave, OpenCutLinesPolylines=project_2.Geometry)
series = Series(Start=_10º_3, Step="0", Count="6")
meshedges_3 = MeshEdges(Mesh=wbweave)  # -> AllE, NakedE
X = UnitX(Factor=Slider(123, range=0..1000))
deccutmesh_2 = DeconstructCutMesh(TriangulatedMeshOrCutMesh=sortcutmesh_2)  # -> Vertices, Faces, Edges
number_slider_4 = Slider(40, range=0..100)
checkobjective = CheckObjective(TriangulatedCutMesh=mbridgecm, XyMirror=False, YzMirror=False, ZxMirror=False, OuterBoundaryCurves=meshedges_2.NakedE)
consvalue = CheckConstraintsValue(
    TriangulatedCutMesh=sortcutmesh_2,
    Iterations=Slider(2, range=0..10),
    XyMirror=False,
    YzMirror=False,
    ZxMirror=False,
    OuterBoundaryCurves=cutmeshedges.MeshNakedEdges)  # -> VertToConstraints, ConstraintsOrder, VertOrderInDup, DupVertIndices, DevConsCount
number_slider_5 = Slider(12, range=0..100)
developcgnr = DevelopCGNR(
    TriangulatedCutMesh=item_2,
    Iterations=number_slider_5,
    XyMirror=False,
    YzMirror=False,
    ZxMirror=False,
    OuterBoundaryCurves=meshedges.NakedE,
    EdgeW=_10º,
    SmoothW=1,
    DevW=_10º_2)  # -> ModifiedCutMesh, DevEnergy
panel_3 = Panel(developcgnr.DevEnergy)
cutmeshedges_2 = CutMeshEdges(TriangulatedMeshOrCutMesh=developcgnr.ModifiedCutMesh)  # -> MeshAllEdges, MeshNakedEdges
merge = Merge(Data1=_10º_4, Data2=series)  # -> flatten(Result)
developcm5 = DevelopCutMesh5(
    TriangulatedCutMesh=sortcutmesh,
    Iterations=number_slider_3,
    XyMirror=False,
    YzMirror=False,
    ZxMirror=False,
    OuterBoundaryCurves=cutmeshedges.MeshNakedEdges,
    Weight=merge)
cutmeshedges_3 = CutMeshEdges(TriangulatedMeshOrCutMesh=developcm5)  # -> MeshAllEdges, MeshNakedEdges
move = Move(Geometry=meshedges_3.NakedE, Motion=X)  # -> Geometry, Transform
movecm = MoveCutMesh(TriangulatedMeshOrCutMesh=meshcutbylines_3, MoveDirection=X)
number_slider_6 = Slider(100, range=0..100)
number_slider_7 = Slider(0, range=0..10)
checkobjective_2 = CheckObjective(
    TriangulatedCutMesh=developcm5,
    XyMirror=False,
    YzMirror=False,
    ZxMirror=False,
    OuterBoundaryCurves=cutmeshedges_3.MeshNakedEdges)
panel_4 = Panel(checkobjective_2)
number_slider_8 = Slider(10, range=0..10)
item_3 = ListItem(List=cutmeshedges_2.MeshAllEdges, Index=Slider(29, range=0..100), Wrap=True)
deccutmesh_3 = DeconstructCutMesh(TriangulatedMeshOrCutMesh=sortcutmesh)  # -> Vertices, Faces, Edges
meshedges_4 = MeshEdges(Mesh=wbweave_2)  # -> AllE, NakedE
bang = ExplodeTree(Data=categorycheck)  # -> Branch0, Branch1, Branch2, Branch3, Branch4
panel_5 = Panel(avr)
meshcutbylines_4 = MeshCutWithCutLines(TriangulatedMeshOrCutMesh=wbweave_2, OpenCutLinesPolylines=crv_3)
panel_6 = Panel(checkobjective)
consvalue_2 = CheckConstraintsValue(
    TriangulatedCutMesh=sortcutmesh_2,
    Iterations=number_slider_3,
    XyMirror=False,
    YzMirror=False,
    ZxMirror=False,
    OuterBoundaryCurves=cutmeshedges.MeshNakedEdges)  # -> VertToConstraints, ConstraintsOrder, VertOrderInDup, DupVertIndices, DevConsCount
_10º_5 = PowerOf10(Value=Slider(0, range=-10..10))
meshcutbylines_5 = MeshCutWithCutLines(TriangulatedMeshOrCutMesh=developcgnr.ModifiedCutMesh, OpenCutLinesPolylines=item_3)
panel_7 = Panel(merge)
sort = SortList(Keys=consvalue.VertOrderInDup)  # -> Keys, ValuesA
item_4 = ListItem(List=deccutmesh_3.Vertices, Index=Slider(26, range=0..100), Wrap=True)
developcm2 = DevelopCutMesh2(
    TriangulatedCutMesh=movecm,
    Iterations=number_slider_4,
    XyMirror=False,
    YzMirror=False,
    ZxMirror=False,
    OuterBoundaryCurves=move.Geometry,
    Alpha=0.1)
item_5 = ListItem(List=deccutmesh_2.Vertices, Index=bang.Branch1, Wrap=True)
developcgnr_2 = DevelopCGNR(
    TriangulatedCutMesh=meshcutbylines_3,
    Iterations=number_slider_4,
    XyMirror=False,
    YzMirror=False,
    ZxMirror=False,
    OuterBoundaryCurves=meshedges_3.NakedE,
    EdgeW=1,
    SmoothW=1,
    DevW=_10º_5)  # -> ModifiedCutMesh, DevEnergy
developcm5_2 = DevelopCutMesh5(
    TriangulatedCutMesh=sortcutmesh_2,
    Iterations=number_slider_5,
    XyMirror=False,
    YzMirror=False,
    ZxMirror=False,
    OuterBoundaryCurves=cutmeshedges.MeshNakedEdges,
    Weight=merge)
larger = LargerThan(SecondNumber="0")  # -> LargerThan, OrEqualTo
number_slider_9 = Slider(21, range=0..100)
categorycheck_2 = CategoryCheck(
    TriangulatedCutMesh=sortcutmesh_2,
    XyMirror=False,
    YzMirror=False,
    ZxMirror=False,
    OuterBoundaryCurves=cutmeshedges.MeshNakedEdges)
_10º_6 = PowerOf10()
consvalue_3 = CheckConstraintsValue(
    TriangulatedCutMesh=sortcutmesh,
    Iterations=number_slider_3,
    XyMirror=False,
    YzMirror=False,
    ZxMirror=False,
    OuterBoundaryCurves=cutmeshedges.MeshNakedEdges)  # -> VertToConstraints, ConstraintsOrder, VertOrderInDup, DupVertIndices, DevConsCount
_10º_7 = PowerOf10(Value=Slider(0, range=-10..10))
sortcutmesh_3 = SortCutMesh(TriangulatedMeshOrCutMesh=meshcutbylines_4)
developcm5_3 = DevelopCutMesh5(
    TriangulatedCutMesh=sortcutmesh_3,
    Iterations=Slider(300, range=0..1000),
    XyMirror=False,
    YzMirror=False,
    ZxMirror=False,
    OuterBoundaryCurves=meshedges_4.NakedE,
    Weight=merge)
mbridgecm_4 = MbridgeCM(TriangulatedMeshOrCutMesh=developcm5_3)
meshedges_5 = MeshEdges(Mesh=mbridgecm_4)  # -> AllE, NakedE
netbff = NetBFF(TriangulatedMeshOrCutMesh=meshcutbylines_5)  # -> CutMesh, FeatureLinesPolylines
cutmeshedges_4 = CutMeshEdges(TriangulatedMeshOrCutMesh=developcm2)  # -> MeshAllEdges, MeshNakedEdges
sort_2 = SortList(Keys=consvalue_2.VertOrderInDup)  # -> Keys, ValuesA
panel_8 = Panel(bang.Branch4)
sort_3 = SortList(Keys=consvalue_2.ConstraintsOrder)  # -> Keys, ValuesA
sortcutmesh_4 = SortCutMesh(TriangulatedMeshOrCutMesh=sortcutmesh)
cutmeshedges_5 = CutMeshEdges(TriangulatedMeshOrCutMesh=developcm5_3)  # -> MeshAllEdges, MeshNakedEdges
mbridgecm_5 = MbridgeCM(TriangulatedMeshOrCutMesh=developcm5_2)
mbridgecm_6 = MbridgeCM(TriangulatedMeshOrCutMesh=netbff.CutMesh)
number_slider_10 = Slider(100, range=0..100)
_10º_8 = PowerOf10(Value=Slider(0, range=-10..10))
_10º_9 = PowerOf10(Value=Slider(3, range=-10..10))
_10º_10 = PowerOf10(Value=Slider(2, range=-10..10))
number_slider_11 = Slider(6846, range=0..10000)
checkobjective_3 = CheckObjective(TriangulatedCutMesh=developcm5_3, XyMirror=False, YzMirror=False, ZxMirror=False, OuterBoundaryCurves=meshedges_5.NakedE)
_10º_11 = PowerOf10(Value=Slider(-3, range=-10..10))
number_slider_12 = Slider(0.01, range=0..0.01)
number_slider_13 = Slider(0.1, range=0..0.1)
number_slider_14 = Slider(10, range=0..10)
panel_9 = Panel(developcgnr_2.DevEnergy)
center = Center(Geometry=mbridgecm_6)  # -> Center, Dimension
pt = Point(Point(0, 0, 0))
item_6 = ListItem(List=cutmeshedges_4.MeshAllEdges, Index="46", Wrap=True)
meshedges_6 = MeshEdges(Mesh=mbridgecm_5)  # -> AllE, NakedE
division = Division(A=avr, B=Slider(200, range=0..1000))
item_7 = ListItem(List=cutmeshedges_5.MeshAllEdges, Index="46", Wrap=True)
rondomcutmesh = RondomCutMesh(TriangulatedMeshOrCutMesh=sortcutmesh_3, Difference=Slider(0.1, range=0..1), Count=Slider(100, range=0..100))
cutmeshedges_6 = CutMeshEdges(TriangulatedMeshOrCutMesh=sortcutmesh_3)  # -> MeshAllEdges, MeshNakedEdges
panel_10 = Panel(checkobjective_3)
meshcutbylines_6 = MeshCutWithCutLines(TriangulatedMeshOrCutMesh=developcm2, OpenCutLinesPolylines=item_6)
developcgnr_3 = DevelopCGNR(
    TriangulatedCutMesh=sortcutmesh_2,
    Iterations=number_slider_5,
    XyMirror=False,
    YzMirror=False,
    ZxMirror=False,
    OuterBoundaryCurves=cutmeshedges.MeshNakedEdges,
    EdgeW=1,
    SmoothW=1,
    DevW=_10º_7)  # -> ModifiedCutMesh, DevEnergy
division_2 = Division(A=developcgnr_3.DevEnergy, B=_10º_7)
move2pt = MoveToPoint(Geometry=mbridgecm_6, PointA=center.Center, PointB=pt)  # -> Moved, Vector, Transform
larger_2 = LargerThan(FirstNumber=consvalue_3.ConstraintsOrder, SecondNumber="-1")  # -> LargerThan, OrEqualTo
checkobjective_4 = CheckObjective(TriangulatedCutMesh=developcm5_2, XyMirror=False, YzMirror=False, ZxMirror=False, OuterBoundaryCurves=meshedges_6.NakedE)
larger_3 = LargerThan(FirstNumber=consvalue_3.DupVertIndices, SecondNumber=Slider(26, range=0..100))  # -> LargerThan, OrEqualTo
meshcutbylines_7 = MeshCutWithCutLines(TriangulatedMeshOrCutMesh=developcm5_3, OpenCutLinesPolylines=item_7)
developcgls = DevelopCGLS(
    TriangulatedCutMesh=sortcutmesh_2,
    Iterations=number_slider_5,
    XyMirror=False,
    YzMirror=False,
    ZxMirror=False,
    OuterBoundaryCurves=cutmeshedges.MeshNakedEdges,
    EdgeW=_10º_11,
    SmoothW=1,
    DevW=_10º_8)
number_slider_15 = Slider(26, range=0..100)
developcm3 = DevelopCutMesh3(
    TriangulatedCutMesh=sortcutmesh_3,
    Iterations=Slider(1000, range=0..1000),
    XyMirror=False,
    YzMirror=False,
    ZxMirror=False,
    OuterBoundaryCurves=meshedges_4.NakedE,
    Alpha=1)
cutmeshedges_7 = CutMeshEdges(TriangulatedMeshOrCutMesh=developcm3)  # -> MeshAllEdges, MeshNakedEdges
item_8 = ListItem(List=cutmeshedges_7.MeshAllEdges, Index="46", Wrap=True)
cutmeshedges_8 = CutMeshEdges(TriangulatedMeshOrCutMesh=developcgnr_2.ModifiedCutMesh)  # -> MeshAllEdges, MeshNakedEdges
item_9 = ListItem(List=rondomcutmesh, Index=Slider(17, range=0..100), Wrap=True)
item_10 = ListItem(List=cutmeshedges_6.MeshAllEdges, Index="46", Wrap=True)
panel_11 = Panel(division_2)
cutmeshedges_9 = CutMeshEdges(TriangulatedMeshOrCutMesh=developcm5_2)  # -> MeshAllEdges, MeshNakedEdges
panel_12 = Panel(rondomcutmesh)
panel_13 = Panel(checkobjective_4)
netbff_2 = NetBFF(TriangulatedMeshOrCutMesh=meshcutbylines_6)  # -> CutMesh, FeatureLinesPolylines
item_11 = ListItem(List=cutmeshedges_8.MeshAllEdges, Index="46", Wrap=True)
netbff_3 = NetBFF(TriangulatedMeshOrCutMesh=meshcutbylines_7)  # -> CutMesh, FeatureLinesPolylines
subtraction = Subtraction(A=larger_2.LargerThan, B=larger_3.LargerThan)
meshcutbylines_8 = MeshCutWithCutLines(TriangulatedMeshOrCutMesh=developcm3, OpenCutLinesPolylines=item_8)
panel_14 = Panel(larger_3.LargerThan)
cutmeshedges_10 = CutMeshEdges(TriangulatedMeshOrCutMesh=item_9)  # -> MeshAllEdges, MeshNakedEdges
meshcutbylines_9 = MeshCutWithCutLines(TriangulatedMeshOrCutMesh=sortcutmesh_3, OpenCutLinesPolylines=item_10)
mbridgecm_7 = MbridgeCM(TriangulatedMeshOrCutMesh=item_9)
cutmeshedges_11 = CutMeshEdges(TriangulatedMeshOrCutMesh=developcm5_2)  # -> MeshAllEdges, MeshNakedEdges
item_12 = ListItem(List=cutmeshedges_9.MeshAllEdges, Index="46", Wrap=True)
center_2 = Center(Geometry=wbweave_2)  # -> Center, Dimension
sortcutmesh_5 = SortCutMesh(TriangulatedMeshOrCutMesh=meshcutbylines_8)
cutmeshedges_12 = CutMeshEdges(TriangulatedMeshOrCutMesh=developcgnr_3.ModifiedCutMesh)  # -> MeshAllEdges, MeshNakedEdges
mbridgecm_8 = MbridgeCM(TriangulatedMeshOrCutMesh=netbff_2.CutMesh)
meshcutbylines_10 = MeshCutWithCutLines(TriangulatedMeshOrCutMesh=developcgnr_2.ModifiedCutMesh, OpenCutLinesPolylines=item_11)
mbridgecm_9 = MbridgeCM(TriangulatedMeshOrCutMesh=netbff_3.CutMesh)
series_2 = Series(Start=0, Step=1, Count=Slider(27, range=0..100))
cutmeshedges_13 = CutMeshEdges(TriangulatedMeshOrCutMesh=meshcutbylines_8)  # -> MeshAllEdges, MeshNakedEdges
cutmeshedges_14 = CutMeshEdges(TriangulatedMeshOrCutMesh=developcgls)  # -> MeshAllEdges, MeshNakedEdges
meshcutbylines_11 = MeshCutWithCutLines(TriangulatedMeshOrCutMesh=developcm5_2, OpenCutLinesPolylines=item_12)
netbff_4 = NetBFF(TriangulatedMeshOrCutMesh=sortcutmesh_5)  # -> CutMesh, FeatureLinesPolylines
len_2 = Length(Curve=cutmeshedges_11.MeshAllEdges)
netbff_5 = NetBFF(TriangulatedMeshOrCutMesh=meshcutbylines_9)  # -> CutMesh, FeatureLinesPolylines
論文用 = Mesh(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)
panel_15 = Panel(categorycheck_2)
netbfflength = NetBFFLength(TriangulatedMeshOrCutMesh=meshcutbylines_9, OuterBoundaryVertCount=-1)  # -> CutMesh, FeatureLinesPolylines
item_13 = ListItem(List=cutmeshedges_10.MeshNakedEdges, Index=series_2, Wrap=True)
developcm2_2 = DevelopCutMesh2(
    TriangulatedCutMesh=item_9,
    Iterations=Slider(94, range=0..200),
    XyMirror=False,
    YzMirror=False,
    ZxMirror=False,
    OuterBoundaryCurves=item_13,
    Alpha=division)
cutmeshedges_15 = CutMeshEdges(TriangulatedMeshOrCutMesh=developcm2_2)  # -> MeshAllEdges, MeshNakedEdges
item_14 = ListItem(List=cutmeshedges_15.MeshAllEdges, Index="46", Wrap=True)
meshcutbylines_12 = MeshCutWithCutLines(TriangulatedMeshOrCutMesh=developcm2_2, OpenCutLinesPolylines=item_14)
center_3 = Center(Geometry=mbridgecm_8)  # -> Center, Dimension
crv_4 = Curve(cutmeshedges_13.MeshNakedEdges)
item_15 = ListItem(List=cutmeshedges_12.MeshAllEdges, Index="46", Wrap=True)
center_4 = Center(Geometry=mbridgecm_9)  # -> Center, Dimension
deccutmesh_4 = DeconstructCutMesh(TriangulatedMeshOrCutMesh=netbff_4.CutMesh)  # -> Vertices, Faces, Edges
mbridgecm_10 = MbridgeCM(TriangulatedMeshOrCutMesh=netbff_4.CutMesh)
panel_16 = Panel(subtraction)
netbff_6 = NetBFF(TriangulatedMeshOrCutMesh=meshcutbylines_11)  # -> CutMesh, FeatureLinesPolylines
item_16 = ListItem(List=cutmeshedges_14.MeshAllEdges, Index="46", Wrap=True)
netbff_7 = NetBFF(TriangulatedMeshOrCutMesh=meshcutbylines_10)  # -> CutMesh, FeatureLinesPolylines
mbridgecm_11 = MbridgeCM(TriangulatedMeshOrCutMesh=netbff_7.CutMesh)
meshcutbylines_13 = MeshCutWithCutLines(TriangulatedMeshOrCutMesh=developcgnr_3.ModifiedCutMesh, OpenCutLinesPolylines=item_15)
netbff_8 = NetBFF(TriangulatedMeshOrCutMesh=meshcutbylines_12)  # -> CutMesh, FeatureLinesPolylines
move2pt_2 = MoveToPoint(Geometry=mbridgecm_9, PointA=center_4.Center, PointB="0,0,0")  # -> Moved, Vector, Transform
mbridgecm_12 = MbridgeCM(TriangulatedMeshOrCutMesh=netbff_6.CutMesh)
center_5 = Center(Geometry=mbridgecm_11)  # -> Center, Dimension
move2pt_3 = MoveToPoint(Geometry=mbridgecm_8, PointA=center_3.Center, PointB=center_2.Center)  # -> Moved, Vector, Transform
meshcutbylines_14 = MeshCutWithCutLines(TriangulatedMeshOrCutMesh=developcgls, OpenCutLinesPolylines=item_16)
center_6 = Center(Geometry=mbridgecm_10)  # -> Center, Dimension
center_7 = Center(Geometry=wbweave_2)  # -> Center, Dimension
_10º_12 = PowerOf10(Value=Slider(-6, range=-10..10))
_10º_13 = PowerOf10(Value=Slider(0, range=-10..10))
pt_2 = Point(Point(0, 0, 0))
panel_17 = Panel("0")
mbridgecm_13 = MbridgeCM(TriangulatedMeshOrCutMesh=netbff_8.CutMesh)
move2pt_4 = MoveToPoint(Geometry=mbridgecm_11, PointA=center_5.Center, PointB=pt_2)  # -> Moved, Vector, Transform
netbff_9 = NetBFF(TriangulatedMeshOrCutMesh=meshcutbylines_13)  # -> CutMesh, FeatureLinesPolylines
categorycheck_3 = CategoryCheck(
    TriangulatedCutMesh=sortcutmesh_3,
    XyMirror=False,
    YzMirror=False,
    ZxMirror=False,
    OuterBoundaryCurves=meshedges_4.NakedE)
netcgnr = NetCGNR(TriangulatedMeshOrCutMesh=developcm5_2, Iterations=Slider(300, range=0..1000), W0=_10º_9, W1=_10º_10, Switch=False)  # -> CutMesh, FeatureLinesPolylines
deccutmesh_5 = DeconstructCutMesh(TriangulatedMeshOrCutMesh=netcgnr.CutMesh)  # -> Vertices, Faces, Edges
cutmeshedges_16 = CutMeshEdges(TriangulatedMeshOrCutMesh=netcgnr.CutMesh)  # -> MeshAllEdges, MeshNakedEdges
len_3 = Length(Curve=cutmeshedges_16.MeshAllEdges)
pdecon = Deconstruct(Point=deccutmesh_5.Vertices)  # -> XComponent, YComponent, ZComponent
subtraction_2 = Subtraction(A=len_2, B=len_3)
avr_2 = Average(Input=pdecon.ZComponent)
sort_4 = SortList(Keys=subtraction_2)  # -> Keys, ValuesA
sqr = Square(Value=sort_4.Keys)
subtraction_3 = Subtraction(A=pdecon.ZComponent, B=avr_2)
sort_5 = SortList(Keys=subtraction_3)  # -> Keys, ValuesA
avr_3 = Average(Input=sort_5.Keys)
item_17 = ListItem(List=sort_5.Keys, Index=0, Wrap=True)  # -> Item1, Item
avr_4 = Average(Input=sqr)
panel_18 = Panel(avr_4)
move2pt_5 = MoveToPoint(Geometry=mbridgecm_10, PointA=center_6.Center, PointB=center_7.Center)  # -> Moved, Vector, Transform
center_8 = Center(Geometry=mbridgecm_12)  # -> Center, Dimension
_10º_14 = PowerOf10(Value=Slider(2, range=-10..10))
netbff_10 = NetBFF(TriangulatedMeshOrCutMesh=meshcutbylines_14)  # -> CutMesh, FeatureLinesPolylines
mbridgecm_14 = MbridgeCM(TriangulatedMeshOrCutMesh=netbff_9.CutMesh)
panel_19 = Panel(sort_4.Keys)
_10º_15 = PowerOf10(Value=Slider(-10, range=-10..10))
panel_20 = Panel([item_17.Item1, item_17.Item])
developcgnr_4 = DevelopCGNR(
    TriangulatedCutMesh=sortcutmesh_3,
    Iterations=number_slider_9,
    XyMirror=False,
    YzMirror=False,
    ZxMirror=False,
    OuterBoundaryCurves=meshedges_4.NakedE,
    EdgeW=_10º_12,
    SmoothW=1,
    DevW=_10º_13)  # -> ModifiedCutMesh, DevEnergy
mbridgecm_15 = MbridgeCM(TriangulatedMeshOrCutMesh=netbff_10.CutMesh)
center_9 = Center(Geometry=mbridgecm_14)  # -> Center, Dimension
pt_3 = Point(Point(0, 0, 0))
center_10 = Center(Geometry=mbridgecm_13)  # -> Center, Dimension
move2pt_6 = MoveToPoint(Geometry=mbridgecm_12, PointA=center_8.Center, PointB="0,0,0")  # -> Moved, Vector, Transform
center_11 = Center(Geometry=mbridgecm_15)  # -> Center, Dimension
pt_4 = Point(Point(0, 0, 0))
developcgls_2 = DevelopCGLS(
    TriangulatedCutMesh=sortcutmesh_3,
    Iterations=number_slider_9,
    XyMirror=False,
    YzMirror=False,
    ZxMirror=False,
    OuterBoundaryCurves=meshedges_4.NakedE,
    EdgeW=_10º_15,
    SmoothW=1,
    DevW=_10º_14)
move2pt_7 = MoveToPoint(Geometry=mbridgecm_13, PointA=center_10.Center, PointB="0,0,0")  # -> Moved, Vector, Transform
division_3 = Division(A=developcgnr_4.DevEnergy, B=_10º_13)
panel_21 = Panel(division_3)
move2pt_8 = MoveToPoint(Geometry=mbridgecm_14, PointA=center_9.Center, PointB=pt_3)  # -> Moved, Vector, Transform
move2pt_9 = MoveToPoint(Geometry=mbridgecm_15, PointA=center_11.Center, PointB=pt_4)  # -> Moved, Vector, Transform
panel_22 = Panel(categorycheck_3)
panel_23 = Panel("""0.001
1000
1000
1000
1000
1000
1000""")
deccutmesh_6 = DeconstructCutMesh(TriangulatedMeshOrCutMesh=sortcutmesh_3)  # -> Vertices, Faces, Edges
cutmeshedges_17 = CutMeshEdges(TriangulatedMeshOrCutMesh=developcgnr_4.ModifiedCutMesh)  # -> MeshAllEdges, MeshNakedEdges
number_slider_16 = Slider(100, range=0..100)
item_18 = ListItem(List=cutmeshedges_17.MeshAllEdges, Index="46", Wrap=True)
cutmeshedges_18 = CutMeshEdges(TriangulatedMeshOrCutMesh=developcgls_2)  # -> MeshAllEdges, MeshNakedEdges
item_19 = ListItem(List=cutmeshedges_18.MeshAllEdges, Index="46", Wrap=True)
item_20 = ListItem(List=deccutmesh_6.Vertices, Index=Slider(44, range=0..100), Wrap=True)
developcm5_4 = DevelopCutMesh5(
    TriangulatedCutMesh=sortcutmesh_3,
    Iterations=Slider(680, range=0..1000),
    XyMirror=False,
    YzMirror=False,
    ZxMirror=False,
    OuterBoundaryCurves=meshedges_4.NakedE,
    Weight=panel_23)
meshcutbylines_15 = MeshCutWithCutLines(TriangulatedMeshOrCutMesh=developcgnr_4.ModifiedCutMesh, OpenCutLinesPolylines=item_18)
meshcutbylines_16 = MeshCutWithCutLines(TriangulatedMeshOrCutMesh=developcgls_2, OpenCutLinesPolylines=item_19)
netbff_11 = NetBFF(TriangulatedMeshOrCutMesh=meshcutbylines_15)  # -> CutMesh, FeatureLinesPolylines
mbridgecm_16 = MbridgeCM(TriangulatedMeshOrCutMesh=netbff_11.CutMesh)
center_12 = Center(Geometry=mbridgecm_16)  # -> Center, Dimension
netbff_12 = NetBFF(TriangulatedMeshOrCutMesh=meshcutbylines_16)  # -> CutMesh, FeatureLinesPolylines
mbridgecm_17 = MbridgeCM(TriangulatedMeshOrCutMesh=netbff_12.CutMesh)
pt_5 = Point(Point(0, 0, 0))
move2pt_10 = MoveToPoint(Geometry=mbridgecm_16, PointA=center_12.Center, PointB=pt_5)  # -> Moved, Vector, Transform
center_13 = Center(Geometry=mbridgecm_17)  # -> Center, Dimension
pt_6 = Point(Point(0, 0, 0))
move2pt_11 = MoveToPoint(Geometry=mbridgecm_17, PointA=center_13.Center, PointB=pt_6)  # -> Moved, Vector, Transform
