# Grasshopper definition 内部切込み_01.gh (Grasshopper 1.0.8)
# plug-ins: Heteroptera, MeshEdit Components, Human, Hagoromo, NGon_RH8

mesh = Mesh(<mesh referenced from the Rhino model>)
panel = Panel("""855
845
283
2055
1928
2506""")
meshedges = MeshEdges(Mesh=mesh)  # -> AllE, NakedE
len = Length(Curve=meshedges.AllE)
mbridgecm = MbridgeCM(TriangulatedMeshOrCutMesh=mesh)
item = ListItem(List=mbridgecm, Index=0, Wrap=True)
panel_2 = Panel(len)
pcnoloop = CutChoicePrincipleNoLoop(
    TriangulatedCutMesh=mbridgecm,
    MaxLength=Slider(1, range=0..100),
    SeedCount=Slider(1, range=0..1),
    Distance=Slider(10, range=0..10),
    Branch=False)  # -> TriangulatedCutMesh, CutChoices
crv = Curve(<curve referenced from the Rhino model>)
meshcutbylines = MeshCutWithCutLines(TriangulatedMeshOrCutMesh=mbridgecm, OpenCutLinesPolylines=crv)
sortcutmesh = SortCutMesh(TriangulatedMeshOrCutMesh=meshcutbylines)
cutmeshedges = CutMeshEdges(TriangulatedMeshOrCutMesh=sortcutmesh)  # -> MeshAllEdges, MeshNakedEdges
item_2 = ListItem(List=cutmeshedges.MeshAllEdges, Index=panel, Wrap=True)
meshcutbylines_2 = MeshCutWithCutLines(TriangulatedMeshOrCutMesh=sortcutmesh, OpenCutLinesPolylines=item_2)
meshedges_2 = MeshEdges(Mesh=mesh)  # -> AllE, NakedE
cutmeshedges_2 = CutMeshEdges(TriangulatedMeshOrCutMesh=meshcutbylines)  # -> MeshAllEdges, MeshNakedEdges
mbridgecm_2 = MbridgeCM(TriangulatedMeshOrCutMesh=meshcutbylines)
mesh_2 = Mesh(mbridgecm_2)
meshedges_3 = MeshEdges(Mesh=mesh_2)  # -> AllE, NakedE
number_slider = Slider(1000, range=0..1000)
_10º = PowerOf10(Value=Slider(3, range=-3..10))
_10º_2 = PowerOf10(Value=Slider(-3, range=-3..10))
crv_2 = Curve(meshedges_3.NakedE)
cutmeshedges_3 = CutMeshEdges(TriangulatedMeshOrCutMesh=meshcutbylines_2)  # -> MeshAllEdges, MeshNakedEdges
number_slider_2 = Slider(0, range=0..100)
crv_3 = Curve(meshedges_2.NakedE)
_10º_3 = PowerOf10(Value=Slider(4, range=-10..10))
_10º_4 = PowerOf10(Value=Slider(-2, range=-10..10))
_10º_5 = PowerOf10(Value=Slider(-6, range=-10..10))
_10º_6 = PowerOf10(Value=Slider(1, range=-10..10))
crv_4 = Curve(cutmeshedges_2.MeshNakedEdges)
_10º_7 = PowerOf10(Value=Slider(-1, range=-10..10))
_10º_8 = PowerOf10(Value=Slider(3, range=-10..10))
weld = WeldMesh(Angle=3.141592654)
unsmooth = Curve([<curve referenced from the Rhino model> x41])
series = Series(Start=_10º, Step="0", Count="6")
merge = Merge(Data1=_10º_2, Data2=series)  # -> flatten(Result)
_10º_9 = PowerOf10(Value=Slider(4, range=-10..10))
_10º_10 = PowerOf10(Value=Slider(-1, range=-10..10))
_10º_11 = PowerOf10(Value=Slider(3, range=-10..10))
weldvertices = MeshWeldVertices(Mesh=mesh_2, Tolerance=0.01)  # -> RuntimeMessage, Mesh
mbridgecm_3 = MbridgeCM(TriangulatedMeshOrCutMesh=weldvertices.Mesh)
sortcutmesh_2 = SortCutMesh(TriangulatedMeshOrCutMesh=mbridgecm_3)
cutmeshedges_4 = CutMeshEdges(TriangulatedMeshOrCutMesh=mbridgecm_3)  # -> MeshAllEdges, MeshNakedEdges
unsmooth_2 = Curve([<curve referenced from the Rhino model> x41])
developcm5 = DevelopCutMesh5(
    TriangulatedCutMesh=meshcutbylines,
    Iterations=Slider(1000, range=0..1000),
    XyMirror=False,
    YzMirror=False,
    ZxMirror=False,
    OuterBoundaryCurves=crv_3,
    FixPointsCrv=crv,
    Weight=merge)  # disabled
fixcrv = Curve(crv)
mbridgecm_4 = MbridgeCM(TriangulatedMeshOrCutMesh=developcm5)
panel_3 = Panel(merge)
developcgnr = DevelopCGNR(
    TriangulatedCutMesh=meshcutbylines,
    Iterations=Slider(0, range=0..100),
    XyMirror=False,
    YzMirror=False,
    ZxMirror=False,
    OuterBoundaryCurves=crv_3,
    FixPointsCrv=crv,
    EdgeW=_10º_5,
    SmoothW=1,
    DevW=_10º_6)  # -> ModifiedCutMesh, DevEnergy
checkobjective = CheckObjective(TriangulatedCutMesh=meshcutbylines, XyMirror=False, YzMirror=False, ZxMirror=False, OuterBoundaryCurves=crv_3)
_10º_12 = PowerOf10(Value=Slider(3, range=-10..10))
developcgls = DevelopCGLS(
    TriangulatedCutMesh=meshcutbylines,
    InnerIter=Slider(200, range=0..1000),
    OuterIter=Slider(100, range=0..1000),
    XyMirror=False,
    YzMirror=False,
    ZxMirror=False,
    OuterBoundaryCurves=crv_3,
    FixPointsCrv=crv,
    EdgeW=_10º_7,
    SmoothW="0",
    DevW=_10º_8)  # disabled
developcgls_2 = DevelopCGLS(
    TriangulatedCutMesh=meshcutbylines,
    InnerIter=Slider(200, range=0..1000),
    OuterIter=Slider(100, range=0..1000),
    XyMirror=False,
    YzMirror=False,
    ZxMirror=False,
    OuterBoundaryCurves=crv_3,
    FixPointsCrv=crv_4,
    UnSmoothCrv=crv,
    EdgeW=_10º_10,
    SmoothW=_10º_9,
    DevW=_10º_11)  # disabled
developcm5_2 = DevelopCutMesh5(
    TriangulatedCutMesh=meshcutbylines_2,
    Iterations=Slider(100, range=0..1000),
    XyMirror=False,
    YzMirror=False,
    ZxMirror=False,
    OuterBoundaryCurves=cutmeshedges_3.MeshNakedEdges,
    FixPointsCrv=crv,
    Weight=merge)
meshedges_4 = MeshEdges(Mesh=mbridgecm_4)  # -> AllE, NakedE
crv_5 = Curve(meshedges_4.NakedE)
panel_4 = Panel(developcgnr.DevEnergy)
panel_5 = Panel(checkobjective)
panel_6 = Panel("""855
845
283
2055
1928
2506""")
cutmeshedges_5 = CutMeshEdges(TriangulatedMeshOrCutMesh=sortcutmesh_2)  # -> MeshAllEdges, MeshNakedEdges
netbfflength = NetBFFLength(TriangulatedMeshOrCutMesh=sortcutmesh_2, OuterBoundaryVertCount=-1)  # -> CutMesh, FeatureLinesPolylines
_10º_13 = PowerOf10(Value=Slider(1, range=-10..10))
cutmeshedges_6 = CutMeshEdges(TriangulatedMeshOrCutMesh=developcm5)  # -> MeshAllEdges, MeshNakedEdges
mbridgecm_5 = MbridgeCM(TriangulatedMeshOrCutMesh=developcgnr.ModifiedCutMesh)
mbridgecm_6 = MbridgeCM(TriangulatedMeshOrCutMesh=developcm5)
developcgls_3 = DevelopCGLS(
    TriangulatedCutMesh=sortcutmesh_2,
    InnerIter=Slider(100, range=0..1000),
    OuterIter=Slider(20, range=0..1000),
    XyMirror=False,
    YzMirror=False,
    ZxMirror=False,
    OuterBoundaryCurves=cutmeshedges_4.MeshNakedEdges,
    EdgeW=_10º_4,
    SmoothW="0",
    DevW=_10º_12)
mbridgecm_7 = MbridgeCM(TriangulatedMeshOrCutMesh=developcgls)
checkobjective_2 = CheckObjective(TriangulatedCutMesh=developcm5, XyMirror=False, YzMirror=False, ZxMirror=False, OuterBoundaryCurves=crv_5)
netbff = NetBFF(TriangulatedMeshOrCutMesh=developcm5_2)  # -> CutMesh, FeatureLinesPolylines
cutmeshedges_7 = CutMeshEdges(TriangulatedMeshOrCutMesh=developcm5_2)  # -> MeshAllEdges, MeshNakedEdges
principle = PrincipleCurvature()
cutmeshedges_8 = CutMeshEdges(TriangulatedMeshOrCutMesh=netbfflength.CutMesh)  # -> MeshAllEdges, MeshNakedEdges
item_3 = ListItem(List=cutmeshedges_6.MeshAllEdges, Index=panel_6, Wrap=True)
meshedges_5 = MeshEdges(Mesh=mbridgecm_5)  # -> AllE, NakedE
_10º_14 = PowerOf10(Value=Slider(3, range=-5..5))
_10º_15 = PowerOf10(Value=Slider(0, range=-3..10))
_10º_16 = PowerOf10(Value=Slider(0, range=-5..5))
cutmeshedges_9 = CutMeshEdges(TriangulatedMeshOrCutMesh=developcm5)  # -> MeshAllEdges, MeshNakedEdges
netlbfgs = NetLBFGS(TriangulatedMeshOrCutMesh=developcgls_2, HasHole="true", W0=1, W1=1, Switch="true")  # -> CutMesh, FeatureLinesPolylines
center = Center(Geometry=mbridgecm_6)  # -> Center, Dimension
meshedges_6 = MeshEdges(Mesh=mbridgecm_7)  # -> AllE, NakedE
panel_7 = Panel(checkobjective_2)
len_2 = Length(Curve=cutmeshedges_5.MeshAllEdges)
checkobjective_3 = CheckObjective(
    TriangulatedCutMesh=developcgnr.ModifiedCutMesh,
    XyMirror=False,
    YzMirror=False,
    ZxMirror=False,
    OuterBoundaryCurves=meshedges_5.NakedE)
len_3 = Length(Curve=cutmeshedges_8.MeshAllEdges)
Y = UnitY(Factor=Slider(24, range=0..100))
netcgnr = NetCGNR(TriangulatedMeshOrCutMesh=developcm5, HasHole=Toggle(True), W0=1, W1=_10º_15, Switch=Toggle(True))  # -> CutMesh, FeatureLinesPolylines
deccutmesh = DeconstructCutMesh(TriangulatedMeshOrCutMesh=developcgls_3)  # -> Vertices, Faces, Edges
checkobjective_4 = CheckObjective(
    TriangulatedCutMesh=developcm5_2,
    XyMirror=False,
    YzMirror=False,
    ZxMirror=False,
    OuterBoundaryCurves=cutmeshedges_7.MeshNakedEdges)
panel_8 = Panel(checkobjective_4)
deccutmesh_2 = DeconstructCutMesh(TriangulatedMeshOrCutMesh=sortcutmesh_2)  # -> Vertices, Faces, Edges
netlbfgs_2 = NetLBFGS(TriangulatedMeshOrCutMesh=sortcutmesh_2, HasHole=False, W0=_10º_14, W1=_10º_16, Switch=False)  # -> CutMesh, FeatureLinesPolylines
len_4 = Length(Curve=cutmeshedges_9.MeshAllEdges)
meshcutbylines_3 = MeshCutWithCutLines(TriangulatedMeshOrCutMesh=developcm5, OpenCutLinesPolylines=item_3)
mbridgecm_8 = MbridgeCM(TriangulatedMeshOrCutMesh=developcgls_2)
checkobjective_5 = CheckObjective(TriangulatedCutMesh=developcgls, XyMirror=False, YzMirror=False, ZxMirror=False, OuterBoundaryCurves=meshedges_6.NakedE)
panel_9 = Panel(checkobjective_5)
panel_11 = Panel(checkobjective_3)
X = UnitX(Factor=1)
Z = UnitZ(Factor=1)
cutmeshedges_10 = CutMeshEdges(TriangulatedMeshOrCutMesh=developcgls_2)  # -> MeshAllEdges, MeshNakedEdges
cutmeshedges_11 = CutMeshEdges(TriangulatedMeshOrCutMesh=netlbfgs.CutMesh)  # -> MeshAllEdges, MeshNakedEdges
subtraction = Subtraction(A=len_2, B=len_3)
abs = Absolute(Value=subtraction)
move = Move(Geometry=mbridgecm_7, Motion=Y)  # -> Geometry, Transform
cutmeshedges_12 = CutMeshEdges(TriangulatedMeshOrCutMesh=netcgnr.CutMesh)  # -> MeshAllEdges, MeshNakedEdges
avr = Average(Input=abs)
cutmeshedges_13 = CutMeshEdges(TriangulatedMeshOrCutMesh=netlbfgs_2.CutMesh)  # -> MeshAllEdges, MeshNakedEdges
meshedges_7 = MeshEdges(Mesh=mbridgecm_8)  # -> AllE, NakedE
netbfflength_2 = NetBFFLength(TriangulatedMeshOrCutMesh=meshcutbylines_3, OuterBoundaryVertCount=-1)  # -> CutMesh, FeatureLinesPolylines; disabled
dist = Distance(PointA=deccutmesh_2.Vertices, PointB=deccutmesh.Vertices)
mesh_3 = Mesh(<mesh referenced from the Rhino model>)
rotatecutmesh = RotateCutMesh(
    TriangulatedMeshOrCutMesh=developcm5,
    RotationCenter=center.Center,
    RotationAxis=X,
    RotationAngle=degrees(Slider(77, range=0..100)))
crv_6 = Curve(cutmeshedges_11.MeshAllEdges)
len_5 = Length(Curve=cutmeshedges_10.MeshAllEdges)
len_6 = Length(Curve=cutmeshedges_11.MeshAllEdges)
len_7 = Length(Curve=cutmeshedges_12.MeshAllEdges)
subtraction_2 = Subtraction(A=len_4, B=len_7)
panel_12 = Panel(avr)
sqr = Square(Value=subtraction_2)
sortcutmesh_3 = SortCutMesh(TriangulatedMeshOrCutMesh=developcm5)
lng = ListLength(List=deccutmesh_2.Vertices)
number_slider_3 = Slider(0, range=0..100)
netbff_2 = NetBFF(TriangulatedMeshOrCutMesh=meshcutbylines_3)  # -> CutMesh, FeatureLinesPolylines
checkobjective_6 = CheckObjective(
    TriangulatedCutMesh=developcgls_2,
    XyMirror=False,
    YzMirror=False,
    ZxMirror=False,
    OuterBoundaryCurves=meshedges_7.NakedE)
panel_13 = Panel(checkobjective_6)
neg = Negative(Value=dist)
_10º_17 = PowerOf10(Value=Slider(0, range=0..10))
_10º_18 = PowerOf10(Value=Slider(1, range=0..10))
division = Division(B=0)
subtraction_3 = Subtraction(A=len_5, B=len_6)
panel_14 = Panel(subtraction_3)
toggle = BooleanToggle(False)
meshedges_8 = MeshEdges(Mesh=mesh_3)  # -> AllE, NakedE
number_slider_4 = Slider(80, range=0..100)
_10º_19 = PowerOf10(Value=Slider(0, range=0..6))
_10º_20 = PowerOf10(Value=Slider(0, range=0..6))
series_2 = Series(Start=0, Step=1, Count=lng)
avr_2 = Average(Input=sqr)
panel_15 = Panel("0")
number_slider_5 = Slider(327, range=0..1000)
netbff2 = NetBFF2(TriangulatedMeshOrCutMesh=sortcutmesh_3, OuterBoundaryVertCount="120")  # -> CutMesh, FeatureLinesPolylines
crv_7 = Curve(meshedges_8.AllE)
sort = SortList(Keys=neg, ValuesA=series_2)  # -> Keys, ValuesA
series_3 = Series(Start=0, Step=1, Count=Slider(38, range=0..100))
netbfflength2 = NetBFFLength2(TriangulatedMeshOrCutMesh=developcm5, OuterBoundaryVertCount="120")  # -> CutMesh, FeatureLinesPolylines
cutmeshedges_14 = CutMeshEdges(TriangulatedMeshOrCutMesh=sortcutmesh_3)  # -> MeshAllEdges, MeshNakedEdges
Y_2 = UnitY(Factor=1)
cutmeshedges_15 = CutMeshEdges()  # -> MeshAllEdges, MeshNakedEdges
item_4 = ListItem(List=sort.ValuesA, Index=series_3, Wrap=True)
division_2 = Division(A=Slider(22, range=0..360), B="180")

flip = FlipCurve(Curve=cutmeshedges_13.MeshAllEdges)  # -> Curve, Flag
len_8 = Length(Curve=cutmeshedges_13.MeshAllEdges)
vec = Vector(cutmeshedges_13.MeshAllEdges)
subtraction_4 = Subtraction(A=len_8, B=len_2)
multiplication = Multiplication(A=vec, B=subtraction_4)
end = EndPoints(Curve=cutmeshedges_13.MeshAllEdges)  # -> Start, End
vec_2 = Vector(flip.Curve)
abs_2 = Absolute(Value=subtraction_4)
larger = LargerThan(FirstNumber=subtraction_4, SecondNumber="0")  # -> flatten(LargerThan), OrEqualTo
multiplication_2 = Multiplication(A=vec_2, B=subtraction_4)
avr_3 = Average(Input=abs_2)
merge_2 = Merge(Data1=ColourSwatch(SwatchColor=RGB(0, 42, 255)), Data2=ColourSwatch(SwatchColor=RGB(255, 0, 0)))
item_5 = ListItem(List=merge_2, Index=larger.LargerThan, Wrap=True)
previewlw = CustomPreviewLineweights(Geometry=cutmeshedges_13.MeshAllEdges, Shader=ColourSwatch(SwatchColor=RGB(158, 158, 158)), Absolute=False)
vdisex = VectorDisplayEx(Point=end.Start, Vector=multiplication, Colour=item_5, Width=2)
vdisex_2 = VectorDisplayEx(Point=end.End, Vector=multiplication_2, Colour=item_5, Width=2)

item_6 = ListItem(List=deccutmesh.Vertices, Index=item_4, Wrap=True)
len_9 = Length(Curve=cutmeshedges_14.MeshAllEdges)
len_10 = Length(Curve=cutmeshedges_15.MeshAllEdges)
pi = Pi(Factor=division_2)
rotatecutmesh_2 = RotateCutMesh(TriangulatedMeshOrCutMesh=rotatecutmesh, RotationCenter=center.Center, RotationAxis=Y_2, RotationAngle=degrees(pi))
facenormal = FaceNormal(TriangulatedMeshOrCutMesh=rotatecutmesh_2, Scale=Slider(0.1, range=0..0.1))
subtraction_5 = Subtraction(A=len_10, B=len_9)
sort_2 = SortList(Keys=subtraction_5)  # -> Keys, ValuesA
panel_16 = Panel(len_9)
netcgnr_2 = NetCGNR(TriangulatedMeshOrCutMesh=rotatecutmesh_2, Iterations=Slider(400, range=0..1000), W0=_10º_18, W1=_10º_17, Switch=False)  # -> CutMesh, FeatureLinesPolylines; disabled
panel_17 = Panel(sort_2.Keys)
