# Grasshopper definition 半球.gh (Grasshopper 1.0.8)
# plug-ins: Pufferfish, Human, Hagoromo, Weaverbird, NGon_RH8

# ----
# 中間用
mesh = Mesh(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)
mesh_2 = Mesh(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)
mesh_3 = Mesh(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)

meshedges = MeshEdges(Mesh=mesh_3)  # -> AllE, NakedE
X = UnitX(Factor=Slider(400, range=0..100000))
msphere = MeshSphere(Base=PlaneXY(0, 0, 0), Radius=Slider(60, range=0..100), UCount=10, VCount=20)
cutmeshgcurvature = CutMeshGCurvature(TriangulatedMeshOrCutMesh=mesh_3)
previewlw = CustomPreviewLineweights(Geometry=meshedges.AllE, Shader=ColourSwatch(SwatchColor=RGBA(194, 194, 255, 0)), Absolute=False)
move = Move(Geometry=msphere, Motion=X)  # -> Geometry, Transform
meshedges_2 = MeshEdges(Mesh=mesh)  # -> AllE, NakedE
crv = Curve([<curve referenced from the Rhino model> x220])
lng = ListLength(List=cutmeshgcurvature)
swatch = ColourSwatch(SwatchColor=RGBA(0, 0, 0, 130))
tri = Triangulate(Mesh=move.Geometry)  # -> Mesh, Count
sort = SortList(Keys=cutmeshgcurvature, ValuesA=cutmeshgcurvature)  # -> Keys, ValuesA
wbweave = WeaverbirdsMeshFromLinesWeaveBack(Lines=crv, MaximumValence=4)
mesh_4 = Mesh(wbweave)
avr = Average(Input=cutmeshgcurvature)
multiplication = Multiplication(A=lng, B=avr)
preview = CustomPreview(
    Geometry=mesh,
    Material={diffuse=RGB(221, 160, 221), emission=RGB(66, 48, 66), shine=0.5, specular=RGB(255, 255, 255), transparency=0})
preview_2 = CustomPreview(Geometry=wbweave, Material=ColourSwatch(SwatchColor=RGBA(52, 92, 65, 130)))
previewlw_2 = CustomPreviewLineweights(Geometry=crv, Shader=ColourSwatch(SwatchColor=RGBA(173, 173, 173, 130)), Absolute=False)
previewlw_3 = CustomPreviewLineweights(Geometry=meshedges_2.AllE, Shader=ColourSwatch(SwatchColor=RGB(0, 0, 0)), Absolute=False)
item = ListItem(List=sort.ValuesA, Index=0, Wrap=True)  # -> Item1, Item
panel = Panel(multiplication)
meshedges_3 = MeshEdges(Mesh=tri.Mesh)  # -> AllE, NakedE
number_slider = Slider(100000, range=0..100000)
meshedges_4 = MeshEdges(Mesh=wbweave)  # -> AllE, NakedE
number_slider_2 = Slider(10000, range=0..10000)
crv_2 = Curve(meshedges_3.AllE)
merge = Merge(Data1=item.Item1, Data2=item.Item, Data3=avr)
sortcutmesh = SortCutMesh(TriangulatedMeshOrCutMesh=wbweave)
developcm2 = DevelopCutMesh2(
    TriangulatedCutMesh=wbweave,
    Iterations=Slider(400000, range=0..1000000),
    XyMirror=False,
    YzMirror=False,
    ZxMirror=False,
    OuterBoundaryCurves=meshedges_4.NakedE,
    Alpha=0.1)
sortcutmesh_2 = SortCutMesh(TriangulatedMeshOrCutMesh=developcm2)
mbridgecm = MbridgeCM(TriangulatedMeshOrCutMesh=sortcutmesh_2)
mesh_5 = Mesh(mbridgecm)
develop = DevelopMesh(TriangulatedMesh=wbweave, Count=Slider(100000, range=0..100000))  # -> ModifiedMesh, A
mesh_6 = Mesh(develop.ModifiedMesh)
mbridgecm_2 = MbridgeCM(TriangulatedMeshOrCutMesh=developcm2)
deccutmesh = DeconstructCutMesh(TriangulatedMeshOrCutMesh=sortcutmesh)  # -> Vertices, Faces, Edges
cutmeshgcurvature_2 = CutMeshGCurvature(TriangulatedMeshOrCutMesh=developcm2)
sortcutmesh_3 = SortCutMesh(TriangulatedMeshOrCutMesh=develop.ModifiedMesh)
meshedges_5 = MeshEdges(Mesh=develop.ModifiedMesh)  # -> AllE, NakedE
preview_3 = CustomPreview(Geometry=develop.ModifiedMesh, Material=ColourSwatch(SwatchColor=RGBA(52, 92, 65, 130)))
deccutmesh_2 = DeconstructCutMesh(TriangulatedMeshOrCutMesh=sortcutmesh_2)  # -> Vertices, Faces, Edges
previewlw_4 = CustomPreviewLineweights(Geometry=meshedges_5.AllE, Shader=ColourSwatch(SwatchColor=RGBA(0, 0, 0, 130)), Absolute=False)
abs = Absolute(Value=cutmeshgcurvature_2)
lng_2 = ListLength(List=cutmeshgcurvature_2)
meshedges_6 = MeshEdges(Mesh=mbridgecm_2)  # -> AllE, NakedE
cutmeshgcurvature_3 = CutMeshGCurvature(TriangulatedMeshOrCutMesh=sortcutmesh_3)
deccutmesh_3 = DeconstructCutMesh(TriangulatedMeshOrCutMesh=sortcutmesh_3)  # -> Vertices, Faces, Edges
series = Series(Start=0, Step=1, Count=lng_2)
series_2 = Series(Start=0, Step=1, Count=Slider(30, range=0..100))
deccutmesh_4 = DeconstructCutMesh(TriangulatedMeshOrCutMesh=sortcutmesh_3)  # -> Vertices, Faces, Edges
preview_4 = CustomPreview(Geometry=mbridgecm_2, Material=ColourSwatch(SwatchColor=RGBA(52, 92, 65, 130)))
previewlw_5 = CustomPreviewLineweights(Geometry=meshedges_6.AllE, Shader=ColourSwatch(SwatchColor=RGBA(0, 0, 0, 130)), Absolute=False)
x_plus_one = XPlusOne(NumberX=series_2)
lng_3 = ListLength(List=cutmeshgcurvature_3)
dist = Distance(PointA=deccutmesh.Vertices, PointB=deccutmesh_2.Vertices)
lng_4 = ListLength(List=dist)
sort_2 = SortList(Keys=abs, ValuesA=series)  # -> Keys, ValuesA
neg = Negative(Value=x_plus_one)
abs_2 = Absolute(Value=cutmeshgcurvature_3)
series_3 = Series(Start=0, Step=1, Count=lng_4)
series_4 = Series(Start=0, Step=1, Count=lng_3)
series_5 = Series(Start=0, Step=1, Count=Slider(30, range=0..100))
item_2 = ListItem(List=sort_2.ValuesA, Index=neg, Wrap=True)
series_6 = Series(Start=0, Step=1, Count=Slider(59, range=0..100))
x_plus_one_2 = XPlusOne(NumberX=series_5)
avr_2 = Average(Input=sort_2.Keys)
item_3 = ListItem(List=sort_2.Keys, Index=0, Wrap=True)  # -> Item1, Item
avr_3 = Average(Input=dist)
x_plus_one_3 = XPlusOne(NumberX=series_6)
sort_3 = SortList(Keys=abs_2, ValuesA=series_4)  # -> Keys, ValuesA
sort_4 = SortList(Keys=dist, ValuesA=series_3)  # -> Keys, ValuesA
neg_2 = Negative(Value=x_plus_one_2)
merge_2 = Merge(Data1=avr_2, Data2=item_3.Item1, Data3=item_3.Item)
neg_3 = Negative(Value=x_plus_one_3)
item_4 = ListItem(List=sort_4.Keys, Index=0, Wrap=True)  # -> Item1, Item
item_5 = ListItem(List=sort_4.ValuesA, Index=neg_2, Wrap=True)
item_6 = ListItem(List=sort_3.ValuesA, Index=neg_3, Wrap=True)
avr_4 = Average(Input=sort_3.Keys)
item_7 = ListItem(List=sort_3.Keys, Index=0, Wrap=True)  # -> Item1, Item
panel_2 = Panel(merge_2)
merge_3 = Merge(Data1=item_4.Item1, Data2=item_4.Item, Data3=avr_3)  # -> flatten(Result)
merge_4 = Merge(Data1=avr_4, Data2=item_7.Item1, Data3=item_7.Item)
panel_3 = Panel(merge_3)
item_8 = ListItem(List=deccutmesh_4.Vertices, Index=item_6, Wrap=True)
panel_4 = Panel(merge_4)
