# Grasshopper definition 外皮の一部.gh (Grasshopper 1.0.8)
# plug-ins: Pufferfish, Human, Crane, Hagoromo, NGon_RH8

mesh = Mesh(<mesh referenced from the Rhino model>)
meshedges = MeshEdges(Mesh=mesh)  # -> AllE, NakedE
preview = CustomPreview(Geometry=mesh, Material=ColourSwatch(SwatchColor=RGBA(173, 173, 173, 130)))
previewlw = CustomPreviewLineweights(Geometry=meshedges.AllE, Shader=ColourSwatch(SwatchColor=RGBA(173, 173, 173, 130)), Absolute=False)
crv = Curve([<curve referenced from the Rhino model> x2])
join = JoinCurves(Curves=crv, Preserve=False)
crv_2 = Curve(<curve referenced from the Rhino model>)
crv_3 = Curve(<curve referenced from the Rhino model>)
crv_4 = Curve(<curve referenced from the Rhino model>)
crv_5 = Curve(<curve referenced from the Rhino model>)
meshedges_2 = MeshEdges(Mesh=mesh)  # -> AllE, NakedE
merge = Merge(Data1=join, Data2=crv_4, Data3=crv_3, Data4=crv_2, Data5=crv_5)  # -> flatten(Result)
meshcutbylines = MeshCutWithCutLines(TriangulatedMeshOrCutMesh=mesh, OpenCutLinesPolylines=merge)
X = UnitX(Factor=Slider(194, range=0..1000))
move = Move(Geometry=meshedges_2.NakedE, Motion=X)  # -> Geometry, Transform
X_2 = UnitX(Factor=Slider(2000, range=0..10000))
meshedges_3 = MeshEdges(Mesh=mesh)  # -> AllE, NakedE
move_2 = Move(Geometry=mesh, Motion=X_2)  # -> Geometry, Transform
movecm = MoveCutMesh(TriangulatedMeshOrCutMesh=meshcutbylines, MoveDirection=X)
mbridgecm = MbridgeCM(TriangulatedMeshOrCutMesh=move_2.Geometry)
number_slider = Slider(1000, range=0..1000)
number_slider_2 = Slider(1000, range=0..1000)
move_3 = Move(Geometry=meshedges_3.NakedE, Motion=X_2)  # -> Geometry, Transform
move_4 = Move(Geometry=merge, Motion=X_2)  # -> Geometry, Transform
number_slider_3 = Slider(1000, range=0..1000)
sortcutmesh = SortCutMesh(TriangulatedMeshOrCutMesh=movecm)
number_slider_4 = Slider(0.4, range=0..1)
deccutmesh = DeconstructCutMesh(TriangulatedMeshOrCutMesh=sortcutmesh)  # -> Vertices, Faces, Edges
sortcutmesh_2 = SortCutMesh(TriangulatedMeshOrCutMesh=mbridgecm)
developcm3 = DevelopCutMesh3(
    TriangulatedCutMesh=movecm,
    Iterations=Slider(10000, range=0..10000),
    XyMirror=False,
    YzMirror=False,
    ZxMirror=False,
    OuterBoundaryCurves=move.Geometry,
    Alpha=Slider(0.1, range=0..0.1))  # disabled
developcm2 = DevelopCutMesh2(
    TriangulatedCutMesh=movecm,
    Iterations=Slider(5000, range=0..10000),
    XyMirror=False,
    YzMirror=False,
    ZxMirror=False,
    OuterBoundaryCurves=move.Geometry,
    Alpha=Slider(0.01, range=0..0.1))  # disabled
developcm3_2 = DevelopCutMesh3(
    TriangulatedCutMesh=move_2.Geometry,
    Iterations=Slider(10000, range=0..10000),
    XyMirror=False,
    YzMirror=False,
    ZxMirror=False,
    OuterBoundaryCurves=move_3.Geometry,
    FixPointsCrv=move_4.Geometry,
    Alpha=1)  # disabled
developcm2_2 = DevelopCutMesh2(
    TriangulatedCutMesh=move_2.Geometry,
    Iterations=Slider(10000, range=0..10000),
    XyMirror=False,
    YzMirror=False,
    ZxMirror=False,
    OuterBoundaryCurves=move_3.Geometry,
    FixPointsCrv=move_4.Geometry,
    Alpha=0.1)  # disabled
deccutmesh_2 = DeconstructCutMesh(TriangulatedMeshOrCutMesh=sortcutmesh_2)  # -> Vertices, Faces, Edges
cutmeshgcurvature = CutMeshGCurvature(TriangulatedMeshOrCutMesh=developcm2_2)
cutmeshgcurvature_2 = CutMeshGCurvature(TriangulatedMeshOrCutMesh=developcm3_2)
deccutmesh_3 = DeconstructCutMesh(TriangulatedMeshOrCutMesh=developcm2_2)  # -> Vertices, Faces, Edges
deccutmesh_4 = DeconstructCutMesh(TriangulatedMeshOrCutMesh=developcm3_2)  # -> Vertices, Faces, Edges
cutmeshgcurvature_3 = CutMeshGCurvature(TriangulatedMeshOrCutMesh=developcm3)
deccutmesh_5 = DeconstructCutMesh(TriangulatedMeshOrCutMesh=developcm3)  # -> Vertices, Faces, Edges
cutmeshgcurvature_4 = CutMeshGCurvature(TriangulatedMeshOrCutMesh=developcm2)
deccutmesh_6 = DeconstructCutMesh(TriangulatedMeshOrCutMesh=developcm2)  # -> Vertices, Faces, Edges
dist = Distance(PointA=deccutmesh_2.Vertices, PointB=deccutmesh_3.Vertices)
lng = ListLength(List=dist)
dist_2 = Distance(PointA=deccutmesh_2.Vertices, PointB=deccutmesh_4.Vertices)
lng_2 = ListLength(List=dist_2)
deccutmesh_7 = DeconstructCutMesh(TriangulatedMeshOrCutMesh=developcm2_2)  # -> Vertices, Faces, Edges
deccutmesh_8 = DeconstructCutMesh(TriangulatedMeshOrCutMesh=developcm3_2)  # -> Vertices, Faces, Edges
dist_3 = Distance(PointA=deccutmesh.Vertices, PointB=deccutmesh_5.Vertices)
lng_3 = ListLength(List=dist_3)
deccutmesh_9 = DeconstructCutMesh(TriangulatedMeshOrCutMesh=developcm3)  # -> Vertices, Faces, Edges
lng_4 = ListLength(List=cutmeshgcurvature)
lng_5 = ListLength(List=cutmeshgcurvature_2)
deccutmesh_10 = DeconstructCutMesh(TriangulatedMeshOrCutMesh=developcm2)  # -> Vertices, Faces, Edges
dist_4 = Distance(PointA=deccutmesh.Vertices, PointB=deccutmesh_6.Vertices)
lng_6 = ListLength(List=dist_4)
lng_7 = ListLength(List=cutmeshgcurvature_3)
series = Series(Start=0, Step=1, Count=lng)
lng_8 = ListLength(List=cutmeshgcurvature_4)
series_2 = Series(Start=0, Step=1, Count=lng_2)
series_3 = Series(Start=0, Step=1, Count=Slider(30, range=0..100))
series_4 = Series(Start=0, Step=1, Count=Slider(30, range=0..100))
x_plus_one = XPlusOne(NumberX=series_3)
series_5 = Series(Start=0, Step=1, Count=lng_3)
x_plus_one_2 = XPlusOne(NumberX=series_4)
series_6 = Series(Start=0, Step=1, Count=Slider(30, range=0..100))
abs = Absolute(Value=cutmeshgcurvature)
abs_2 = Absolute(Value=cutmeshgcurvature_2)
series_7 = Series(Start=0, Step=1, Count=lng_4)
series_8 = Series(Start=0, Step=1, Count=lng_5)
x_plus_one_3 = XPlusOne(NumberX=series_6)
series_9 = Series(Start=0, Step=1, Count=lng_6)
abs_3 = Absolute(Value=cutmeshgcurvature_3)
series_10 = Series(Start=0, Step=1, Count=Slider(30, range=0..100))
x_plus_one_4 = XPlusOne(NumberX=series_10)
series_11 = Series(Start=0, Step=1, Count=Slider(100, range=0..100))
series_12 = Series(Start=0, Step=1, Count=lng_7)
abs_4 = Absolute(Value=cutmeshgcurvature_4)
series_13 = Series(Start=0, Step=1, Count=Slider(100, range=0..100))
avr = Average(Input=dist)
series_14 = Series(Start=0, Step=1, Count=lng_8)
avr_2 = Average(Input=dist_2)
sort = SortList(Keys=dist, ValuesA=series)  # -> Keys, ValuesA
sort_2 = SortList(Keys=dist_2, ValuesA=series_2)  # -> Keys, ValuesA
series_15 = Series(Start=0, Step=1, Count=Slider(100, range=0..100))
series_16 = Series(Start=0, Step=1, Count=Slider(59, range=0..100))
avr_3 = Average(Input=dist_3)
sort_3 = SortList(Keys=dist_3, ValuesA=series_5)  # -> Keys, ValuesA
neg = Negative(Value=x_plus_one)
neg_2 = Negative(Value=x_plus_one_2)
sort_4 = SortList(Keys=abs, ValuesA=series_7)  # -> Keys, ValuesA
sort_5 = SortList(Keys=abs_2, ValuesA=series_8)  # -> Keys, ValuesA
avr_4 = Average(Input=dist_4)
neg_3 = Negative(Value=x_plus_one_3)
sort_6 = SortList(Keys=dist_4, ValuesA=series_9)  # -> Keys, ValuesA
x_plus_one_5 = XPlusOne(NumberX=series_11)
x_plus_one_6 = XPlusOne(NumberX=series_13)
sort_7 = SortList(Keys=abs_3, ValuesA=series_12)  # -> Keys, ValuesA
sort_8 = SortList(Keys=abs_4, ValuesA=series_14)  # -> Keys, ValuesA
item = ListItem(List=sort.Keys, Index=0, Wrap=True)  # -> Item1, Item
item_2 = ListItem(List=sort_2.Keys, Index=0, Wrap=True)  # -> Item1, Item
x_plus_one_7 = XPlusOne(NumberX=series_15)
neg_4 = Negative(Value=x_plus_one_4)
x_plus_one_8 = XPlusOne(NumberX=series_16)
neg_5 = Negative(Value=x_plus_one_5)
neg_6 = Negative(Value=x_plus_one_6)
item_3 = ListItem(List=sort.ValuesA, Index=neg, Wrap=True)
item_4 = ListItem(List=sort_3.Keys, Index=0, Wrap=True)  # -> Item1, Item
item_5 = ListItem(List=sort_2.ValuesA, Index=neg_2, Wrap=True)
neg_7 = Negative(Value=x_plus_one_7)
item_6 = ListItem(List=sort_3.ValuesA, Index=neg_3, Wrap=True)
neg_8 = Negative(Value=x_plus_one_8)
item_7 = ListItem(List=sort_6.Keys, Index=0, Wrap=True)  # -> Item1, Item
cull_i = CullIndex(List=sort_5.Keys, Indices=neg_6, Wrap=True)
item_8 = ListItem(List=sort_6.ValuesA, Index=neg_4, Wrap=True)
merge_2 = Merge(Data1=item.Item1, Data2=item.Item, Data3=avr)  # -> flatten(Result)
merge_3 = Merge(Data1=item_2.Item1, Data2=item_2.Item, Data3=avr_2)  # -> flatten(Result)
item_9 = ListItem(List=sort_4.ValuesA, Index=neg_5, Wrap=True)
item_10 = ListItem(List=sort_5.ValuesA, Index=neg_6, Wrap=True)
merge_4 = Merge(Data1=item_4.Item1, Data2=item_4.Item, Data3=avr_3)  # -> flatten(Result)
item_11 = ListItem(List=sort_7.ValuesA, Index=neg_7, Wrap=True)
avr_5 = Average(Input=sort_4.Keys)
item_12 = ListItem(List=sort_8.ValuesA, Index=neg_8, Wrap=True)
cull_i_2 = CullIndex(List=sort_4.Keys, Indices=neg_5, Wrap=True)
item_13 = ListItem(List=sort_4.Keys, Index=0, Wrap=True)  # -> Item1, Item
item_14 = ListItem(List=sort_5.Keys, Index=0, Wrap=True)  # -> Item1, Item
avr_6 = Average(Input=sort_5.Keys)
merge_5 = Merge(Data1=item_7.Item1, Data2=item_7.Item, Data3=avr_4)  # -> flatten(Result)
avr_7 = Average(Input=sort_7.Keys)
item_15 = ListItem(List=sort_7.Keys, Index=0, Wrap=True)  # -> Item1, Item
avr_8 = Average(Input=sort_8.Keys)
item_16 = ListItem(List=sort_8.Keys, Index=0, Wrap=True)  # -> Item1, Item
avr_9 = Average(Input=cull_i)
avr_10 = Average(Input=cull_i_2)
panel = Panel(merge_2)
panel_2 = Panel(merge_3)
merge_6 = Merge(Data1=avr_5, Data2=item_13.Item1, Data3=item_13.Item, Data4=avr_10)  # -> flatten(Result)
merge_7 = Merge(Data1=avr_6, Data2=item_14.Item1, Data3=item_14.Item, Data4=avr_9)  # -> flatten(Result)
item_17 = ListItem(List=deccutmesh_3.Vertices, Index=item_3, Wrap=True)
item_18 = ListItem(List=deccutmesh_4.Vertices, Index=item_5, Wrap=True)
panel_3 = Panel(merge_4)
merge_8 = Merge(Data1=avr_7, Data2=item_15.Item1, Data3=item_15.Item)
item_19 = ListItem(List=deccutmesh_5.Vertices, Index=item_6, Wrap=True)
merge_9 = Merge(Data1=avr_8, Data2=item_16.Item1, Data3=item_16.Item)
panel_4 = Panel(merge_5)
item_20 = ListItem(List=deccutmesh_6.Vertices, Index=item_8, Wrap=True)
panel_5 = Panel(merge_6)
item_21 = ListItem(List=deccutmesh_7.Vertices, Index=item_9, Wrap=True)
panel_6 = Panel(merge_7)
item_22 = ListItem(List=deccutmesh_8.Vertices, Index=item_10, Wrap=True)
panel_7 = Panel(merge_8)
item_23 = ListItem(List=deccutmesh_9.Vertices, Index=item_11, Wrap=True)
panel_8 = Panel(merge_9)
item_24 = ListItem(List=deccutmesh_10.Vertices, Index=item_12, Wrap=True)
mesh_2 = Mesh(mesh)
cutmeshgcurvature_5 = CutMeshGCurvature(TriangulatedMeshOrCutMesh=mesh_2)
abs_5 = Absolute(Value=cutmeshgcurvature_5)
sort_9 = SortList(Keys=abs_5)  # -> Keys, ValuesA
item_25 = ListItem(List=sort_9.Keys, Index=0, Wrap=True)  # -> Item1, Item
avr_11 = Average(Input=abs_5)
gradient = Gradient(
    LowerLimit=item_25.Item,
    UpperLimit=Slider(0.12, range=0..1),
    Parameter=abs_5,
    stops=[0: RGB(234, 38, 0), 0.25: RGB(234, 126, 0), 0.5: RGB(254, 244, 84), 0.75: RGB(173, 203, 249), 1: RGB(75, 107, 169)])
panel_9 = Panel(avr_11)
mbridgecm_2 = MbridgeCM(TriangulatedMeshOrCutMesh=mesh)
mcol = MeshColours(Mesh=mesh_2, Colours=gradient)
sortcutmesh_3 = SortCutMesh(TriangulatedMeshOrCutMesh=mbridgecm_2)
deccutmesh_11 = DeconstructCutMesh(TriangulatedMeshOrCutMesh=sortcutmesh_3)  # -> Vertices, Faces, Edges
number_slider_5 = Slider(1e-08, range=0..1e-08)
number_slider_6 = Slider(0.0001, range=0..0.0001)
number_slider_7 = Slider(300, range=0..1000)
panel_10 = Panel("""0.001
1000
1000
1000
1000
1000
1000""")
mesh_3 = Mesh(<mesh referenced from the Rhino model>)
mbridgecm_3 = MbridgeCM(TriangulatedMeshOrCutMesh=mesh_3)
meshedges_4 = MeshEdges(Mesh=mesh_3)  # -> AllE, NakedE
developcm5 = DevelopCutMesh5(
    TriangulatedCutMesh=mbridgecm_3,
    Iterations=Slider(300, range=0..1000),
    XyMirror=False,
    YzMirror=False,
    ZxMirror=False,
    OuterBoundaryCurves=meshedges_4.NakedE,
    Weight=panel_10)
cutmeshedges = CutMeshEdges(TriangulatedMeshOrCutMesh=developcm5)  # -> MeshAllEdges, MeshNakedEdges
checkobjective = CheckObjective(
    TriangulatedCutMesh=developcm5,
    XyMirror=False,
    YzMirror=False,
    ZxMirror=False,
    OuterBoundaryCurves=cutmeshedges.MeshNakedEdges)
developcgls = DevelopCGLS(
    TriangulatedCutMesh=mbridgecm_3,
    Iterations=number_slider_7,
    XyMirror=False,
    YzMirror=False,
    ZxMirror=False,
    OuterBoundaryCurves=meshedges_4.NakedE,
    EdgeW=number_slider_5,
    SmoothW=number_slider_5,
    DevW=Slider(100, range=0..100))
panel_11 = Panel(checkobjective)
developcgnr = DevelopCGNR(
    TriangulatedCutMesh=mbridgecm_3,
    Iterations=number_slider_7,
    XyMirror=False,
    YzMirror=False,
    ZxMirror=False,
    OuterBoundaryCurves=meshedges_4.NakedE,
    EdgeW=1,
    SmoothW=1,
    DevW=1)  # -> ModifiedCutMesh, DevEnergy
sortcutmesh_4 = SortCutMesh(TriangulatedMeshOrCutMesh=developcgnr.ModifiedCutMesh)
netbff = NetBFF()  # -> CutMesh, FeatureLinesPolylines
number_slider_8 = Slider(3, range=0..100)
netbff_2 = NetBFF(TriangulatedMeshOrCutMesh=sortcutmesh_4)  # -> CutMesh, FeatureLinesPolylines
cutmeshedges_2 = CutMeshEdges(TriangulatedMeshOrCutMesh=developcgnr.ModifiedCutMesh)  # -> MeshAllEdges, MeshNakedEdges
sortcutmesh_5 = SortCutMesh(TriangulatedMeshOrCutMesh=mesh_3)
checkobjective_2 = CheckObjective(TriangulatedCutMesh=mbridgecm_3, XyMirror=False, YzMirror=False, ZxMirror=False, OuterBoundaryCurves=meshedges_4.NakedE)
cutmeshedges_3 = CutMeshEdges(TriangulatedMeshOrCutMesh=developcgls)  # -> MeshAllEdges, MeshNakedEdges
cutmeshedges_4 = CutMeshEdges(TriangulatedMeshOrCutMesh=sortcutmesh_4)  # -> MeshAllEdges, MeshNakedEdges
number_slider_9 = Slider(100, range=0..100)
cutmeshedges_5 = CutMeshEdges(TriangulatedMeshOrCutMesh=netbff_2.CutMesh)  # -> MeshAllEdges, MeshNakedEdges
checkobjective_3 = CheckObjective(
    TriangulatedCutMesh=developcgnr.ModifiedCutMesh,
    XyMirror=False,
    YzMirror=False,
    ZxMirror=False,
    OuterBoundaryCurves=cutmeshedges_2.MeshNakedEdges)
panel_12 = Panel(developcgnr.DevEnergy)
vertexnormal = VertexNormal(TriangulatedMeshOrCutMesh=sortcutmesh_5, Scale=Slider(2, range=0..10))
number_slider_10 = Slider(4, range=0..10)
panel_13 = Panel(checkobjective_2)
number_slider_11 = Slider(8, range=0..10)
normalcheck = NormalCheck(TriangulatedMeshOrCutMesh=sortcutmesh_5, Scale=Slider(0.1, range=0..0.1))
checkobjective_4 = CheckObjective(
    TriangulatedCutMesh=developcgls,
    XyMirror=False,
    YzMirror=False,
    ZxMirror=False,
    OuterBoundaryCurves=cutmeshedges_3.MeshNakedEdges)
panel_14 = Panel(checkobjective_3)
len = Length(Curve=cutmeshedges_5.MeshAllEdges)
len_2 = Length(Curve=cutmeshedges_4.MeshAllEdges)
series_17 = Series(Start=Slider(154, range=0..1000), Step="0", Count=number_slider_10)
panel_15 = Panel(checkobjective_4)
subtraction = Subtraction(A=len_2, B=len)
mbridgecm_4 = MbridgeCM(TriangulatedMeshOrCutMesh=mesh_3)
series_18 = Series(Start=Slider(124, range=0..1000), Step="0", Count=number_slider_11)
principle = PrincipleCurvature(TriangulatedMeshOrCutMesh=sortcutmesh_5)
lng_9 = ListLength(List=principle)
pcnoloop = CutChoicePrincipleNoLoop(
    TriangulatedCutMesh=sortcutmesh_5,
    MaxLength=series_17,
    SeedCount=number_slider_10,
    Distance=Slider(36, range=0..100),
    Branch=Toggle(True))  # -> TriangulatedCutMesh, CutChoices
sortcutmesh_6 = SortCutMesh(TriangulatedMeshOrCutMesh=mbridgecm_4)
panel_16 = Panel(subtraction)
deccutmesh_12 = DeconstructCutMesh(TriangulatedMeshOrCutMesh=sortcutmesh_5)  # -> Vertices, Faces, Edges
neg_9 = Negative(Value=principle)
series_19 = Series(Start=0, Step=1, Count=lng_9)
number_slider_12 = Slider(10, range=0..10)
flip = FlipMatrix(Data=pcnoloop.CutChoices)
series_20 = Series(Start=0, Step=1, Count=Slider(30, range=0..100))
sort_10 = SortList(Keys=neg_9, ValuesA=series_19)  # -> Keys, ValuesA
cutchoice1 = CutChoice1(
    TriangulatedCutMesh=sortcutmesh_6,
    MaxLength=series_18,
    SeedCount=number_slider_11,
    Distance=Slider(30, range=0..1000),
    Branch=Toggle(True))  # -> TriangulatedCutMesh, CutChoices
crv_6 = Curve(pcnoloop.CutChoices)
number_slider_13 = Slider(23, range=0..100)
principle_2 = PrincipleCurvature(TriangulatedMeshOrCutMesh=sortcutmesh_6)
getmaintree = GetMainTree(TriangulatedMeshOrCutMesh=pcnoloop.TriangulatedCutMesh, OpenCutLinesPolylines=crv_6, IsTopological=Toggle(True))
item_26 = ListItem(List=flip, Index=Slider(1, range=0..10), Wrap=True)
item_27 = ListItem(List=sort_10.ValuesA, Index=series_20, Wrap=True)
flip_2 = FlipMatrix(Data=getmaintree)
panel_17 = Panel(principle_2)
item_28 = ListItem(List=deccutmesh_12.Vertices, Index=Slider(210, range=0..327), Wrap=True)
item_29 = ListItem(List=flip_2, Index=Slider(1, range=0..10), Wrap=True)
panel_18 = Panel(principle)
crv_7 = Curve(cutchoice1.CutChoices)
crv_8 = Curve([<curve referenced from the Rhino model> x2])
join_2 = JoinCurves(Curves=crv_8, Preserve=False)
crv_9 = Curve(<curve referenced from the Rhino model>)
crv_10 = Curve(<curve referenced from the Rhino model>)
crv_11 = Curve(<curve referenced from the Rhino model>)
crv_12 = Curve(<curve referenced from the Rhino model>)
merge_10 = Merge(Data1=join_2, Data2=crv_11, Data3=crv_10, Data4=crv_9, Data5=crv_12)  # -> flatten(Result)
meshcutbylines_2 = MeshCutWithCutLines(TriangulatedMeshOrCutMesh=mesh_3, OpenCutLinesPolylines=merge_10)
_10º = PowerOf10(Value=Slider(0, range=-3..10))
_10º_2 = PowerOf10(Value=Slider(3, range=0..10))
X_3 = UnitX(Factor=Slider(194, range=0..1000))
mbridgecm_5 = MbridgeCM(TriangulatedMeshOrCutMesh=mesh_3)
panel_19 = Panel("0")
series_21 = Series(Start=_10º_2, Step="0", Count="6")
crv_13 = Curve([<curve referenced from the Rhino model> x7])
merge_11 = Merge(Data1=_10º, Data2=series_21)  # -> flatten(Result)
mbridgecm_6 = MbridgeCM(TriangulatedMeshOrCutMesh=mesh_3)
meshcutbylines_3 = MeshCutWithCutLines(TriangulatedMeshOrCutMesh=mbridgecm_5, OpenCutLinesPolylines=crv_13)
panel_20 = Panel(merge_11)
X_4 = UnitX(Factor=Slider(2000, range=0..10000))
meshedges_5 = MeshEdges(Mesh=mesh_3)  # -> AllE, NakedE
sortcutmesh_7 = SortCutMesh(TriangulatedMeshOrCutMesh=mbridgecm_6)
crv_14 = Curve(crv_13)
number_slider_14 = Slider(0, range=0..10)
explode = Explode(Curve=crv_14, Recursive=True)  # -> flatten(Segments), Vertices
move_5 = Move(Geometry=mesh_3, Motion=X_4)  # -> Geometry, Transform
number_slider_15 = Slider(0, range=-10..0)
meshedges_6 = MeshEdges(Mesh=mesh_3)  # -> AllE, NakedE
move_6 = Move(Geometry=meshedges_6.NakedE, Motion=X_3)  # -> Geometry, Transform
crv_15 = Curve(meshedges_6.NakedE)
developcm5_2 = DevelopCutMesh5(
    TriangulatedCutMesh=meshcutbylines_3,
    Iterations=Slider(300, range=0..1000),
    XyMirror=False,
    YzMirror=False,
    ZxMirror=False,
    OuterBoundaryCurves=meshedges_6.NakedE,
    Weight=merge_11)
mbridgecm_7 = MbridgeCM(TriangulatedMeshOrCutMesh=developcm5_2)
explode_2 = Explode(Curve=crv_15, Recursive=True)  # -> flatten(Segments), Vertices
meshedges_7 = MeshEdges(Mesh=mbridgecm_7)  # -> AllE, NakedE
len_3 = Length(Curve=meshedges_6.AllE)
merge_12 = Merge(Data1=explode.Segments, Data2=explode_2.Segments)
number_slider_16 = Slider(0, range=0..100)
movecm_2 = MoveCutMesh(TriangulatedMeshOrCutMesh=meshcutbylines_2, MoveDirection=X_3)
netbff2 = NetBFF2(TriangulatedMeshOrCutMesh=developcm5_2, OuterBoundaryVertCount="88")  # -> CutMesh, FeatureLinesPolylines
signedarea = SignedArea(TriangulatedMeshOrCutMesh=netbff2.CutMesh)
cutmeshedges_6 = CutMeshEdges(TriangulatedMeshOrCutMesh=developcm5_2)  # -> MeshAllEdges, MeshNakedEdges
deccutmesh_13 = DeconstructCutMesh(TriangulatedMeshOrCutMesh=sortcutmesh_7)  # -> Vertices, Faces, Edges
_10º_3 = PowerOf10(Value=Slider(0, range=-10..0))
_10º_4 = PowerOf10(Value=Slider(0, range=0..100))
sort_11 = SortList(Keys=signedarea)  # -> Keys, ValuesA
mbridgecm_8 = MbridgeCM(TriangulatedMeshOrCutMesh=move_5.Geometry)
deccutmesh_14 = DeconstructCutMesh(TriangulatedMeshOrCutMesh=developcm5_2)  # -> Vertices, Faces, Edges
number_slider_17 = Slider(1000, range=0..1000)
move_7 = Move(Geometry=meshedges_5.NakedE, Motion=X_4)  # -> Geometry, Transform
move_8 = Move(Geometry=merge_10, Motion=X_4)  # -> Geometry, Transform
checkobjective_5 = CheckObjective(
    TriangulatedCutMesh=developcm5_2,
    XyMirror=False,
    YzMirror=False,
    ZxMirror=False,
    OuterBoundaryCurves=cutmeshedges_6.MeshNakedEdges)
number_slider_18 = Slider(1000, range=0..1000)
number_slider_19 = Slider(1000, range=0..1000)
sortcutmesh_8 = SortCutMesh(TriangulatedMeshOrCutMesh=movecm_2)
netcgnr = NetCGNR(TriangulatedMeshOrCutMesh=developcm5_2, OuterBoundaryVertCount="true", W0=_10º_3, W1=_10º_4, Switch=Toggle(True))  # -> CutMesh, FeatureLinesPolylines
deccutmesh_15 = DeconstructCutMesh(TriangulatedMeshOrCutMesh=netcgnr.CutMesh)  # -> Vertices, Faces, Edges
number_slider_20 = Slider(0.4, range=0..1)
panel_22 = Panel(checkobjective_5)
number_slider_21 = Slider(100, range=0..100)
item_30 = ListItem(List=deccutmesh_14.Vertices, Index=deccutmesh_14.Faces, Wrap=True)
panel_23 = Panel(sort_11.Keys)
item_31 = ListItem(List=deccutmesh_15.Vertices, Index=deccutmesh_15.Faces, Wrap=True)
deccutmesh_16 = DeconstructCutMesh(TriangulatedMeshOrCutMesh=sortcutmesh_8)  # -> Vertices, Faces, Edges
signedarea_2 = SignedArea(TriangulatedMeshOrCutMesh=netcgnr.CutMesh)
flip_3 = FlipMatrix(Data=deccutmesh_14.Faces)
sortcutmesh_9 = SortCutMesh(TriangulatedMeshOrCutMesh=mbridgecm_8)
developcm3_3 = DevelopCutMesh3(
    TriangulatedCutMesh=movecm_2,
    Iterations=Slider(10000, range=0..10000),
    XyMirror=False,
    YzMirror=False,
    ZxMirror=False,
    OuterBoundaryCurves=move_6.Geometry,
    Alpha=Slider(0.1, range=0..0.1))  # disabled
flip_4 = FlipMatrix(Data=deccutmesh_15.Faces)
pline = PolyLine(Vertices=item_30, Closed="true")
developcm2_3 = DevelopCutMesh2(
    TriangulatedCutMesh=movecm_2,
    Iterations=Slider(5000, range=0..10000),
    XyMirror=False,
    YzMirror=False,
    ZxMirror=False,
    OuterBoundaryCurves=move_6.Geometry,
    Alpha=Slider(0.01, range=0..0.1))  # disabled
pline_2 = PolyLine(Vertices=item_31, Closed="true")
developcm3_4 = DevelopCutMesh3(
    TriangulatedCutMesh=move_5.Geometry,
    Iterations=Slider(10000, range=0..10000),
    XyMirror=False,
    YzMirror=False,
    ZxMirror=False,
    OuterBoundaryCurves=move_7.Geometry,
    FixPointsCrv=move_8.Geometry,
    Alpha=1)  # disabled
netbfflength2 = NetBFFLength2(TriangulatedMeshOrCutMesh=developcm5_2, OuterBoundaryVertCount="88")  # -> CutMesh, FeatureLinesPolylines
sort_12 = SortList(Keys=signedarea_2)  # -> Keys, ValuesA
sortcutmesh_10 = SortCutMesh(TriangulatedMeshOrCutMesh=developcm5_2)
developcm2_4 = DevelopCutMesh2(
    TriangulatedCutMesh=move_5.Geometry,
    Iterations=Slider(10000, range=0..10000),
    XyMirror=False,
    YzMirror=False,
    ZxMirror=False,
    OuterBoundaryCurves=move_7.Geometry,
    FixPointsCrv=move_8.Geometry,
    Alpha=0.1)  # disabled
deccutmesh_17 = DeconstructCutMesh(TriangulatedMeshOrCutMesh=sortcutmesh_9)  # -> Vertices, Faces, Edges
area = Area(Geometry=pline)  # -> flatten(Area), Centroid
area_2 = Area(Geometry=pline_2)  # -> flatten(Area), Centroid
avr_12 = Average(Input=area_2.Area)
panel_24 = Panel(avr_12)
panel_25 = Panel(sort_12.Keys)
sort_13 = SortList(Keys=area.Area)  # -> Keys, ValuesA
panel_26 = Panel(sort_13.Keys)
sort_14 = SortList(Keys=area_2.Area)  # -> Keys, ValuesA
panel_27 = Panel(sort_14.Keys)
cutmeshedges_7 = CutMeshEdges(TriangulatedMeshOrCutMesh=netcgnr.CutMesh)  # -> MeshAllEdges, MeshNakedEdges
cutmeshedges_8 = CutMeshEdges(TriangulatedMeshOrCutMesh=sortcutmesh_10)  # -> MeshAllEdges, MeshNakedEdges

# ----
# 移動距離が大きかったもの
number_slider_22 = Slider(30, range=0..100)
deccutmesh_18 = DeconstructCutMesh(TriangulatedMeshOrCutMesh=developcm2_4)  # -> Vertices, Faces, Edges
dist_5 = Distance(PointA=deccutmesh_17.Vertices, PointB=deccutmesh_18.Vertices)
lng_10 = ListLength(List=dist_5)
series_22 = Series(Start=0, Step=1, Count=lng_10)
series_23 = Series(Start=0, Step=1, Count=number_slider_22)
x_plus_one_9 = XPlusOne(NumberX=series_23)
avr_13 = Average(Input=dist_5)
sort_15 = SortList(Keys=dist_5, ValuesA=series_22)  # -> Keys, ValuesA
neg_10 = Negative(Value=x_plus_one_9)
item_32 = ListItem(List=sort_15.Keys, Index=0, Wrap=True)  # -> Item1, Item
item_33 = ListItem(List=sort_15.ValuesA, Index=neg_10, Wrap=True)
merge_13 = Merge(Data1=item_32.Item1, Data2=item_32.Item, Data3=avr_13)  # -> flatten(Result)
panel_28 = Panel(merge_13)
item_34 = ListItem(List=deccutmesh_18.Vertices, Index=item_33, Wrap=True)

# ----
# 移動距離が大きかったもの
number_slider_23 = Slider(30, range=0..100)
deccutmesh_19 = DeconstructCutMesh(TriangulatedMeshOrCutMesh=developcm3_4)  # -> Vertices, Faces, Edges
dist_6 = Distance(PointA=deccutmesh_17.Vertices, PointB=deccutmesh_19.Vertices)
lng_11 = ListLength(List=dist_6)
series_24 = Series(Start=0, Step=1, Count=lng_11)
series_25 = Series(Start=0, Step=1, Count=number_slider_23)
x_plus_one_10 = XPlusOne(NumberX=series_25)
avr_14 = Average(Input=dist_6)
sort_16 = SortList(Keys=dist_6, ValuesA=series_24)  # -> Keys, ValuesA
neg_11 = Negative(Value=x_plus_one_10)
item_35 = ListItem(List=sort_16.Keys, Index=0, Wrap=True)  # -> Item1, Item
item_36 = ListItem(List=sort_16.ValuesA, Index=neg_11, Wrap=True)
merge_14 = Merge(Data1=item_35.Item1, Data2=item_35.Item, Data3=avr_14)  # -> flatten(Result)
panel_29 = Panel(merge_14)
item_37 = ListItem(List=deccutmesh_19.Vertices, Index=item_36, Wrap=True)

# ----
# ガウス曲率が大きかったもの
cutmeshgcurvature_6 = CutMeshGCurvature(TriangulatedMeshOrCutMesh=developcm3_3)
deccutmesh_20 = DeconstructCutMesh(TriangulatedMeshOrCutMesh=developcm3_3)  # -> Vertices, Faces, Edges
lng_12 = ListLength(List=cutmeshgcurvature_6)
abs_6 = Absolute(Value=cutmeshgcurvature_6)
series_26 = Series(Start=0, Step=1, Count=lng_12)
series_27 = Series(Start=0, Step=1, Count=Slider(100, range=0..100))
sort_17 = SortList(Keys=abs_6, ValuesA=series_26)  # -> Keys, ValuesA
x_plus_one_11 = XPlusOne(NumberX=series_27)
neg_12 = Negative(Value=x_plus_one_11)
item_38 = ListItem(List=sort_17.ValuesA, Index=neg_12, Wrap=True)
avr_15 = Average(Input=sort_17.Keys)
item_39 = ListItem(List=sort_17.Keys, Index=0, Wrap=True)  # -> Item1, Item
merge_15 = Merge(Data1=avr_15, Data2=item_39.Item1, Data3=item_39.Item)
panel_30 = Panel(merge_15)
item_40 = ListItem(List=deccutmesh_20.Vertices, Index=item_38, Wrap=True)

# ----
# 移動距離が大きかったもの
number_slider_24 = Slider(30, range=0..100)
deccutmesh_21 = DeconstructCutMesh(TriangulatedMeshOrCutMesh=developcm3_3)  # -> Vertices, Faces, Edges
dist_7 = Distance(PointA=deccutmesh_16.Vertices, PointB=deccutmesh_21.Vertices)
lng_13 = ListLength(List=dist_7)
series_28 = Series(Start=0, Step=1, Count=lng_13)
series_29 = Series(Start=0, Step=1, Count=number_slider_24)
x_plus_one_12 = XPlusOne(NumberX=series_29)
avr_16 = Average(Input=dist_7)
sort_18 = SortList(Keys=dist_7, ValuesA=series_28)  # -> Keys, ValuesA
neg_13 = Negative(Value=x_plus_one_12)
item_41 = ListItem(List=sort_18.Keys, Index=0, Wrap=True)  # -> Item1, Item
item_42 = ListItem(List=sort_18.ValuesA, Index=neg_13, Wrap=True)
merge_16 = Merge(Data1=item_41.Item1, Data2=item_41.Item, Data3=avr_16)  # -> flatten(Result)
panel_31 = Panel(merge_16)
item_43 = ListItem(List=deccutmesh_21.Vertices, Index=item_42, Wrap=True)

cutmeshgcurvature_7 = CutMeshGCurvature(TriangulatedMeshOrCutMesh=developcm2_3)
deccutmesh_22 = DeconstructCutMesh(TriangulatedMeshOrCutMesh=developcm2_3)  # -> Vertices, Faces, Edges
lng_14 = ListLength(List=cutmeshgcurvature_7)
abs_7 = Absolute(Value=cutmeshgcurvature_7)
series_30 = Series(Start=0, Step=1, Count=lng_14)
series_31 = Series(Start=0, Step=1, Count=Slider(59, range=0..100))
sort_19 = SortList(Keys=abs_7, ValuesA=series_30)  # -> Keys, ValuesA
x_plus_one_13 = XPlusOne(NumberX=series_31)
neg_14 = Negative(Value=x_plus_one_13)
item_44 = ListItem(List=sort_19.ValuesA, Index=neg_14, Wrap=True)
avr_17 = Average(Input=sort_19.Keys)
item_45 = ListItem(List=sort_19.Keys, Index=0, Wrap=True)  # -> Item1, Item
merge_17 = Merge(Data1=avr_17, Data2=item_45.Item1, Data3=item_45.Item)
panel_32 = Panel(merge_17)
item_46 = ListItem(List=deccutmesh_22.Vertices, Index=item_44, Wrap=True)

deccutmesh_23 = DeconstructCutMesh(TriangulatedMeshOrCutMesh=developcm2_3)  # -> Vertices, Faces, Edges
dist_8 = Distance(PointA=deccutmesh_16.Vertices, PointB=deccutmesh_23.Vertices)
lng_15 = ListLength(List=dist_8)
series_32 = Series(Start=0, Step=1, Count=lng_15)
series_33 = Series(Start=0, Step=1, Count=Slider(30, range=0..100))
x_plus_one_14 = XPlusOne(NumberX=series_33)
avr_18 = Average(Input=dist_8)
sort_20 = SortList(Keys=dist_8, ValuesA=series_32)  # -> Keys, ValuesA
neg_15 = Negative(Value=x_plus_one_14)
item_47 = ListItem(List=sort_20.Keys, Index=0, Wrap=True)  # -> Item1, Item
item_48 = ListItem(List=sort_20.ValuesA, Index=neg_15, Wrap=True)
merge_18 = Merge(Data1=item_47.Item1, Data2=item_47.Item, Data3=avr_18)  # -> flatten(Result)
panel_33 = Panel(merge_18)
item_49 = ListItem(List=deccutmesh_23.Vertices, Index=item_48, Wrap=True)

len_4 = Length(Curve=cutmeshedges_7.MeshAllEdges)
len_5 = Length(Curve=cutmeshedges_8.MeshAllEdges)
subtraction_2 = Subtraction(A=len_4, B=len_5)
panel_34 = Panel(subtraction_2)
sqr = Square(Value=subtraction_2)
avr_19 = Average(Input=sqr)

# ----
# Crane
cmesh_from_mesh = CMeshFromMesh(Mesh=mesh_3)
developable = Developable()
static_solver = CraneStaticSolver(
    CMesh=cmesh_from_mesh,
    Constraints=developable,
    NRIteration=50,
    CGNRIteration=100,
    Threshold=1e-13,
    Solve=Toggle(True),
    IsRigidEdge=False,
    IsPanelFlat=True,
    IsFoldBlock=True,
    IsConstraint=True)  # -> CMesh, RigidOrigami, Residual
deconstruct_cmesh = DeconstructCMesh(CMesh=static_solver.CMesh)  # -> Mesh, Mountain, Valley, Boundary, Unassigned, Triangulate, Edges, Inner
develop_mesh = DevelopMesh(Mesh=deconstruct_cmesh.Mesh)  # -> DevelopMesh, FaceTree

demesh = DeconstructMesh(Mesh=deconstruct_cmesh.Mesh)  # -> Vertices, Faces, Colours, Normals
demesh_2 = DeconstructMesh(Mesh=mesh_3)  # -> Vertices, Faces, Colours, Normals
dist_9 = Distance(PointA=demesh.Vertices, PointB=demesh_2.Vertices)
sort_21 = SortList(Keys=dist_9)  # -> Keys, ValuesA
avr_20 = Average(Input=dist_9)
item_50 = ListItem(List=sort_21.Keys, Index=0, Wrap=True)  # -> Item1, Item
merge_19 = Merge(Data1=item_50.Item, Data2=item_50.Item1, Data3=avr_20)
panel_35 = Panel(merge_19)

# ----
# 最適化前
cutmeshgcurvature_8 = CutMeshGCurvature(TriangulatedMeshOrCutMesh=sortcutmesh_7)
abs_8 = Absolute(Value=cutmeshgcurvature_8)
lng_16 = ListLength(List=cutmeshgcurvature_8)
series_34 = Series(Start=0, Step=1, Count=lng_16)
series_35 = Series(Start=0, Step=1, Count=Slider(30, range=0..100))
sort_22 = SortList(Keys=abs_8, ValuesA=series_34)  # -> Keys, ValuesA
x_plus_one_15 = XPlusOne(NumberX=series_35)
neg_16 = Negative(Value=x_plus_one_15)
item_51 = ListItem(List=sort_22.ValuesA, Index=neg_16, Wrap=True)
avr_21 = Average(Input=sort_22.Keys)
item_52 = ListItem(List=sort_22.Keys, Index=0, Wrap=True)  # -> Item1, Item
merge_20 = Merge(Data1=avr_21, Data2=item_52.Item1, Data3=item_52.Item)
panel_36 = Panel(merge_20)
item_53 = ListItem(List=deccutmesh_13.Vertices, Index=item_51, Wrap=True)

_10º_5 = PowerOf10(Value=Slider(0, range=-3..10))
_10º_6 = PowerOf10(Value=Slider(3, range=0..10))

cutmeshgcurvature_9 = CutMeshGCurvature(TriangulatedMeshOrCutMesh=deconstruct_cmesh.Mesh)
mbridgecm_9 = MbridgeCM(TriangulatedMeshOrCutMesh=deconstruct_cmesh.Mesh)
cutmeshgcurvature_10 = CutMeshGCurvature(TriangulatedMeshOrCutMesh=mbridgecm_9)
deccutmesh_24 = DeconstructCutMesh(TriangulatedMeshOrCutMesh=mbridgecm_9)  # -> Vertices, Faces, Edges
lng_17 = ListLength(List=cutmeshgcurvature_10)
abs_9 = Absolute(Value=cutmeshgcurvature_10)
series_36 = Series(Start=0, Step=1, Count=lng_17)
series_37 = Series(Start=0, Step=1, Count=Slider(59, range=0..100))
x_plus_one_16 = XPlusOne(NumberX=series_37)
sort_23 = SortList(Keys=abs_9, ValuesA=series_36)  # -> Keys, ValuesA
neg_17 = Negative(Value=x_plus_one_16)
item_54 = ListItem(List=sort_23.ValuesA, Index=neg_17, Wrap=True)
avr_22 = Average(Input=sort_23.Keys)
item_55 = ListItem(List=sort_23.Keys, Index=0, Wrap=True)  # -> Item1, Item
merge_21 = Merge(Data1=avr_22, Data2=item_55.Item1, Data3=item_55.Item)
panel_37 = Panel(merge_21)
item_56 = ListItem(List=deccutmesh_24.Vertices, Index=item_54, Wrap=True)

series_38 = Series(Start=_10º_6, Step="0", Count="6")
merge_22 = Merge(Data1=_10º_5, Data2=series_38)  # -> flatten(Result)
cutmeshedges_9 = CutMeshEdges(TriangulatedMeshOrCutMesh=mbridgecm_9)  # -> MeshAllEdges, MeshNakedEdges
panel_38 = Panel(merge_22)
number_slider_25 = Slider(23, range=0..100)
checkobjective_6 = CheckObjective(
    TriangulatedCutMesh=mbridgecm_9,
    XyMirror=False,
    YzMirror=False,
    ZxMirror=False,
    OuterBoundaryCurves=cutmeshedges_9.MeshNakedEdges)
元形状 = Mesh(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)
ハイブリッド = Mesh(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)
従来手法 = Mesh(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)
新手法 = Mesh(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)
developcm5_3 = DevelopCutMesh5(
    TriangulatedCutMesh=mesh_3,
    Iterations=Slider(30, range=0..1000),
    XyMirror=False,
    YzMirror=False,
    ZxMirror=False,
    OuterBoundaryCurves=meshedges_6.NakedE,
    FixPointsCrv=meshedges_6.NakedE,
    Weight=merge_22)
cutmeshedges_10 = CutMeshEdges(TriangulatedMeshOrCutMesh=mbridgecm_9)  # -> MeshAllEdges, MeshNakedEdges
_10º_7 = PowerOf10(Value=Slider(0, range=-3..10))
_10º_8 = PowerOf10(Value=Slider(3, range=0..10))
merge_23 = Merge(Data1=元形状, Data2=従来手法, Data3=新手法, Data4=ハイブリッド)  # -> flatten(Result)
X_5 = UnitX(Factor=Slider(534, range=0..1000))
checkobjective_7 = CheckObjective(
    TriangulatedCutMesh=mbridgecm_9,
    XyMirror=False,
    YzMirror=False,
    ZxMirror=False,
    OuterBoundaryCurves=cutmeshedges_10.MeshNakedEdges)
move_9 = Move(Geometry=merge_23, Motion=X_5)  # -> Geometry, Transform
cutmeshedges_11 = CutMeshEdges(TriangulatedMeshOrCutMesh=developcm5_3)  # -> MeshAllEdges, MeshNakedEdges
series_39 = Series(Start=_10º_8, Step="0", Count="6")
item_57 = ListItem(List=move_9.Geometry, Index=0, Wrap=True)  # -> Item, Item1, Item2, Item3
mesh_4 = Mesh(item_57.Item)
merge_24 = Merge(Data1=_10º_7, Data2=series_39)  # -> flatten(Result)
checkobjective_8 = CheckObjective(
    TriangulatedCutMesh=developcm5_3,
    XyMirror=False,
    YzMirror=False,
    ZxMirror=False,
    OuterBoundaryCurves=cutmeshedges_11.MeshNakedEdges)
panel_39 = Panel(checkobjective_8)
panel_40 = Panel(checkobjective_7)
crv_16 = Curve([<curve referenced from the Rhino model> x26])
meshedges_8 = MeshEdges(Mesh=item_57.Item)  # -> AllE, NakedE
meshedges_9 = MeshEdges(Mesh=item_57.Item)  # -> AllE, NakedE
crv_17 = Curve([<curve referenced from the Rhino model> x10])
cutmeshedges_12 = CutMeshEdges(TriangulatedMeshOrCutMesh=sortcutmesh_7)  # -> MeshAllEdges, MeshNakedEdges
panel_41 = Panel(merge_24)
crv_18 = Curve(meshedges_8.AllE)
number_slider_26 = Slider(100000, range=0..100000)
previewlw_2 = CustomPreviewLineweights(Geometry=meshedges_9.AllE, Shader=ColourSwatch(SwatchColor=RGBA(194, 194, 255, 0)), Absolute=False)
number_slider_27 = Slider(10000, range=0..10000)
previewlw_3 = CustomPreviewLineweights(Geometry=crv_17, Shader=ColourSwatch(SwatchColor=RGB(87, 87, 212)), Thickness=Slider(3, range=0..10), Absolute=False)
previewlw_4 = CustomPreviewLineweights(Geometry=crv_16, Shader=ColourSwatch(SwatchColor=RGB(232, 174, 49)), Thickness=Slider(3, range=0..10), Absolute=False)
meshedges_10 = MeshEdges(Mesh=item_57.Item3)  # -> AllE, NakedE
avr_23 = Average(Input=len_3)
len_6 = Length(Curve=cutmeshedges_12.MeshAllEdges)
division = Division(A=avr_23, B=Slider(200, range=0..1000))
preview_2 = CustomPreview(
    Geometry=item_57.Item3,
    Material={diffuse=RGB(221, 160, 221), emission=RGB(66, 48, 66), shine=0.5, specular=RGB(255, 255, 255), transparency=0})
previewlw_5 = CustomPreviewLineweights(Geometry=meshedges_10.AllE, Shader=ColourSwatch(SwatchColor=RGB(0, 0, 0)), Absolute=False)
developcm2_5 = DevelopCutMesh2(
    TriangulatedCutMesh=mesh_3,
    Iterations=Slider(31, range=0..1000),
    XyMirror=False,
    YzMirror=False,
    ZxMirror=False,
    OuterBoundaryCurves=meshedges_6.NakedE,
    Alpha="1")
categorycheck = CategoryCheck(TriangulatedCutMesh=mesh_3, XyMirror=False, YzMirror=False, ZxMirror=False, OuterBoundaryCurves=meshedges_6.NakedE)
cutmeshedges_13 = CutMeshEdges(TriangulatedMeshOrCutMesh=developcm2_5)  # -> MeshAllEdges, MeshNakedEdges
mbridgecm_10 = MbridgeCM(TriangulatedMeshOrCutMesh=developcm2_5)
panel_42 = Panel(categorycheck)
develop = DevelopMesh(TriangulatedMesh=mesh_3, Count=Slider(1000, range=0..1000))  # -> ModifiedMesh, A
checkobjective_9 = CheckObjective(
    TriangulatedCutMesh=developcm2_5,
    XyMirror=False,
    YzMirror=False,
    ZxMirror=False,
    OuterBoundaryCurves=cutmeshedges_13.MeshNakedEdges)
panel_43 = Panel(checkobjective_9)
meshedges_11 = MeshEdges(Mesh=develop.ModifiedMesh)  # -> AllE, NakedE
meshedges_12 = MeshEdges(Mesh=develop.ModifiedMesh)  # -> AllE, NakedE
checkobjective_10 = CheckObjective(
    TriangulatedCutMesh=develop.ModifiedMesh,
    XyMirror=False,
    YzMirror=False,
    ZxMirror=False,
    OuterBoundaryCurves=meshedges_11.NakedE)
panel_44 = Panel(checkobjective_10)
netbff_3 = NetBFF(TriangulatedMeshOrCutMesh=develop.ModifiedMesh)  # -> CutMesh, FeatureLinesPolylines
netcgnr_2 = NetCGNR(
    TriangulatedMeshOrCutMesh=develop.ModifiedMesh,
    OuterBoundaryVertCount=Slider(88, range=0..100),
    W0=1,
    W1=0.01,
    Switch=False)  # -> CutMesh, FeatureLinesPolylines

# ----
# ガウス曲率が大きかったもの
cutmeshgcurvature_11 = CutMeshGCurvature(TriangulatedMeshOrCutMesh=developcm2_4)
deccutmesh_25 = DeconstructCutMesh(TriangulatedMeshOrCutMesh=developcm2_4)  # -> Vertices, Faces, Edges
lng_18 = ListLength(List=cutmeshgcurvature_11)
abs_10 = Absolute(Value=cutmeshgcurvature_11)
series_40 = Series(Start=0, Step=1, Count=lng_18)
series_41 = Series(Start=0, Step=1, Count=Slider(100, range=0..100))
sort_24 = SortList(Keys=abs_10, ValuesA=series_40)  # -> Keys, ValuesA
x_plus_one_17 = XPlusOne(NumberX=series_41)
neg_18 = Negative(Value=x_plus_one_17)
item_58 = ListItem(List=sort_24.ValuesA, Index=neg_18, Wrap=True)
avr_24 = Average(Input=sort_24.Keys)
item_59 = ListItem(List=sort_24.Keys, Index=0, Wrap=True)  # -> Item1, Item
item_60 = ListItem(List=deccutmesh_25.Vertices, Index=item_58, Wrap=True)

cull_i_3 = CullIndex(List=sort_24.Keys, Indices=neg_18, Wrap=True)
avr_25 = Average(Input=cull_i_3)

merge_25 = Merge(Data1=avr_24, Data2=item_59.Item1, Data3=item_59.Item, Data4=avr_25)  # -> flatten(Result)
panel_45 = Panel(merge_25)

# ----
# ガウス曲率が大きかったもの
cutmeshgcurvature_12 = CutMeshGCurvature(TriangulatedMeshOrCutMesh=developcm3_4)
deccutmesh_26 = DeconstructCutMesh(TriangulatedMeshOrCutMesh=developcm3_4)  # -> Vertices, Faces, Edges
lng_19 = ListLength(List=cutmeshgcurvature_12)
abs_11 = Absolute(Value=cutmeshgcurvature_12)
series_42 = Series(Start=0, Step=1, Count=lng_19)
series_43 = Series(Start=0, Step=1, Count=Slider(100, range=0..100))
sort_25 = SortList(Keys=abs_11, ValuesA=series_42)  # -> Keys, ValuesA
x_plus_one_18 = XPlusOne(NumberX=series_43)
neg_19 = Negative(Value=x_plus_one_18)
item_61 = ListItem(List=sort_25.ValuesA, Index=neg_19, Wrap=True)
item_62 = ListItem(List=sort_25.Keys, Index=0, Wrap=True)  # -> Item1, Item
avr_26 = Average(Input=sort_25.Keys)
item_63 = ListItem(List=deccutmesh_26.Vertices, Index=item_61, Wrap=True)

cull_i_4 = CullIndex(List=sort_25.Keys, Indices=neg_19, Wrap=True)
avr_27 = Average(Input=cull_i_4)

merge_26 = Merge(Data1=avr_26, Data2=item_62.Item1, Data3=item_62.Item, Data4=avr_27)  # -> flatten(Result)
panel_46 = Panel(merge_26)

# ----
# Selfのみ
number_slider_28 = Slider(10000, range=0..10000)
number_slider_29 = Slider(100000, range=0..100000)
develop_2 = DevelopMesh(TriangulatedMesh=mesh_3, Count=number_slider_28)  # -> ModifiedMesh, A
sortcutmesh_11 = SortCutMesh(TriangulatedMeshOrCutMesh=develop_2.ModifiedMesh)
deccutmesh_27 = DeconstructCutMesh(TriangulatedMeshOrCutMesh=sortcutmesh_11)  # -> Vertices, Faces, Edges

cutmeshedges_14 = CutMeshEdges(TriangulatedMeshOrCutMesh=sortcutmesh_11)  # -> MeshAllEdges, MeshNakedEdges
checkobjective_11 = CheckObjective(
    TriangulatedCutMesh=sortcutmesh_11,
    XyMirror=False,
    YzMirror=False,
    ZxMirror=False,
    OuterBoundaryCurves=cutmeshedges_14.MeshNakedEdges)
panel_47 = Panel(checkobjective_11)
netbff_4 = NetBFF(TriangulatedMeshOrCutMesh=develop_2.ModifiedMesh)  # -> CutMesh, FeatureLinesPolylines
cutmeshedges_15 = CutMeshEdges(TriangulatedMeshOrCutMesh=netbff_4.CutMesh)  # -> MeshAllEdges, MeshNakedEdges
developcm5_4 = DevelopCutMesh5(
    TriangulatedCutMesh=netbff_4.CutMesh,
    Iterations=Slider(90, range=0..100),
    XyMirror=False,
    YzMirror=False,
    ZxMirror=False,
    OuterBoundaryCurves=cutmeshedges_15.MeshNakedEdges,
    Weight=merge_24)
checkobjective_12 = CheckObjective(
    TriangulatedCutMesh=developcm5_4,
    XyMirror=False,
    YzMirror=False,
    ZxMirror=False,
    OuterBoundaryCurves=cutmeshedges_15.MeshNakedEdges)
panel_48 = Panel(checkobjective_12)

# ----
# ハイブリッド
number_slider_30 = Slider(100000, range=0..100000)
developcm2_6 = DevelopCutMesh2(
    TriangulatedCutMesh=mesh_3,
    Iterations=number_slider_30,
    XyMirror=False,
    YzMirror=False,
    ZxMirror=False,
    OuterBoundaryCurves=meshedges_6.NakedE,
    Alpha=0.1)  # disabled
cutmeshedges_16 = CutMeshEdges(TriangulatedMeshOrCutMesh=developcm2_6)  # -> MeshAllEdges, MeshNakedEdges
crv_19 = Curve(cutmeshedges_16.MeshNakedEdges)
developcm3_5 = DevelopCutMesh3(
    TriangulatedCutMesh=developcm2_6,
    Iterations=Slider(10000, range=0..10000),
    XyMirror=False,
    YzMirror=False,
    ZxMirror=False,
    OuterBoundaryCurves=crv_19,
    Alpha=1)

cutmeshedges_17 = CutMeshEdges(TriangulatedMeshOrCutMesh=developcm3_5)  # -> MeshAllEdges, MeshNakedEdges
len_7 = Length(Curve=cutmeshedges_17.MeshAllEdges)
subtraction_3 = Subtraction(A=len_6, B=len_7)
abs_12 = Absolute(Value=subtraction_3)
sort_26 = SortList(Keys=abs_12)  # -> Keys, ValuesA
avr_28 = Average(Input=abs_12)
item_64 = ListItem(List=sort_26.Keys, Index=0, Wrap=True)  # -> Item1, Item
merge_27 = Merge(Data1=item_64.Item1, Data2=item_64.Item, Data3=avr_28)  # -> flatten(Result)
panel_49 = Panel(merge_27)

# ----
# Selfのみ
number_slider_31 = Slider(2000, range=0..10000)
developcm3_6 = DevelopCutMesh3(
    TriangulatedCutMesh=mesh_3,
    Iterations=number_slider_31,
    XyMirror=False,
    YzMirror=False,
    ZxMirror=False,
    OuterBoundaryCurves=meshedges_6.NakedE,
    Alpha=1)
deccutmesh_28 = DeconstructCutMesh(TriangulatedMeshOrCutMesh=developcm3_6)  # -> Vertices, Faces, Edges

sortcutmesh_12 = SortCutMesh(TriangulatedMeshOrCutMesh=developcm3_6)
cutmeshedges_18 = CutMeshEdges(TriangulatedMeshOrCutMesh=sortcutmesh_12)  # -> MeshAllEdges, MeshNakedEdges
netbff_5 = NetBFF(TriangulatedMeshOrCutMesh=developcm3_6)  # -> CutMesh, FeatureLinesPolylines
netbfflength = NetBFFLength(TriangulatedMeshOrCutMesh=developcm3_6, OuterBoundaryVertCount=-1)  # -> CutMesh, FeatureLinesPolylines

# ----
# 長さの最適化まで入れたら長さのずれが0.1倍になった
cutmeshedges_19 = CutMeshEdges(TriangulatedMeshOrCutMesh=developcm3_6)  # -> MeshAllEdges, MeshNakedEdges
cutmeshedges_20 = CutMeshEdges(TriangulatedMeshOrCutMesh=netbfflength.CutMesh)  # -> MeshAllEdges, MeshNakedEdges
cutmeshedges_21 = CutMeshEdges(TriangulatedMeshOrCutMesh=netbff_5.CutMesh)  # -> MeshAllEdges, MeshNakedEdges
len_8 = Length(Curve=cutmeshedges_19.MeshAllEdges)
len_9 = Length(Curve=cutmeshedges_21.MeshAllEdges)
len_10 = Length(Curve=cutmeshedges_19.MeshAllEdges)
len_11 = Length(Curve=cutmeshedges_20.MeshAllEdges)
subtraction_4 = Subtraction(A=len_9, B=len_8)
subtraction_5 = Subtraction(A=len_11, B=len_10)
abs_13 = Absolute(Value=subtraction_4)
abs_14 = Absolute(Value=subtraction_5)
sort_27 = SortList(Keys=abs_13)  # -> Keys, ValuesA
avr_29 = Average(Input=abs_13)
sort_28 = SortList(Keys=abs_14)  # -> Keys, ValuesA
avr_30 = Average(Input=abs_14)
item_65 = ListItem(List=sort_27.Keys, Index=0, Wrap=True)  # -> Item1, Item
item_66 = ListItem(List=sort_28.Keys, Index=0, Wrap=True)  # -> Item1, Item
merge_28 = Merge(Data1=item_65.Item1, Data2=item_65.Item, Data3=avr_29)  # -> flatten(Result)
merge_29 = Merge(Data1=item_66.Item1, Data2=item_66.Item, Data3=avr_30)  # -> flatten(Result)
panel_50 = Panel(merge_28)
panel_51 = Panel(merge_29)

cruling = CheckRuling(TriangulatedDevelopableCutMesh=sortcutmesh_12, Width=Slider(3, range=0..10), Lines=cutmeshedges_18.MeshNakedEdges)  # disabled

cutmeshgcurvature_13 = CutMeshGCurvature(TriangulatedMeshOrCutMesh=developcm2_6)
abs_15 = Absolute(Value=cutmeshgcurvature_13)
lng_20 = ListLength(List=cutmeshgcurvature_13)
series_44 = Series(Start=0, Step=1, Count=lng_20)
series_45 = Series(Start=0, Step=1, Count=Slider(30, range=0..100))
sort_29 = SortList(Keys=abs_15, ValuesA=series_44)  # -> Keys, ValuesA

cutmeshgcurvature_14 = CutMeshGCurvature(TriangulatedMeshOrCutMesh=sortcutmesh_11)
lng_21 = ListLength(List=cutmeshgcurvature_14)
abs_16 = Absolute(Value=cutmeshgcurvature_14)
series_46 = Series(Start=0, Step=1, Count=lng_21)
series_47 = Series(Start=0, Step=1, Count=Slider(59, range=0..100))
sort_30 = SortList(Keys=abs_16, ValuesA=series_46)  # -> Keys, ValuesA

cutmeshgcurvature_15 = CutMeshGCurvature(TriangulatedMeshOrCutMesh=developcm3_6)
abs_17 = Absolute(Value=cutmeshgcurvature_15)
lng_22 = ListLength(List=cutmeshgcurvature_15)
series_48 = Series(Start=0, Step=1, Count=lng_22)
series_49 = Series(Start=0, Step=1, Count=Slider(30, range=0..100))
sort_31 = SortList(Keys=abs_17, ValuesA=series_48)  # -> Keys, ValuesA

deccutmesh_29 = DeconstructCutMesh(TriangulatedMeshOrCutMesh=sortcutmesh_11)  # -> Vertices, Faces, Edges
dist_10 = Distance(PointA=deccutmesh_13.Vertices, PointB=deccutmesh_29.Vertices)
lng_23 = ListLength(List=dist_10)
series_50 = Series(Start=0, Step=1, Count=lng_23)
series_51 = Series(Start=0, Step=1, Count=Slider(30, range=0..100))
avr_31 = Average(Input=dist_10)
sort_32 = SortList(Keys=dist_10, ValuesA=series_50)  # -> Keys, ValuesA
item_67 = ListItem(List=sort_32.Keys, Index=0, Wrap=True)  # -> Item1, Item
merge_30 = Merge(Data1=item_67.Item1, Data2=item_67.Item, Data3=avr_31)  # -> flatten(Result)
panel_52 = Panel(merge_30)

x_plus_one_19 = XPlusOne(NumberX=series_51)
x_plus_one_20 = XPlusOne(NumberX=series_47)
avr_32 = Average(Input=sort_30.Keys)
item_68 = ListItem(List=sort_30.Keys, Index=0, Wrap=True)  # -> Item1, Item
merge_31 = Merge(Data1=avr_32, Data2=item_68.Item1, Data3=item_68.Item)

neg_20 = Negative(Value=x_plus_one_19)
item_69 = ListItem(List=sort_32.ValuesA, Index=neg_20, Wrap=True)
item_70 = ListItem(List=deccutmesh_13.Vertices, Index=item_69, Wrap=True)

neg_21 = Negative(Value=x_plus_one_20)
item_71 = ListItem(List=sort_30.ValuesA, Index=neg_21, Wrap=True)
panel_53 = Panel(merge_31)
item_72 = ListItem(List=deccutmesh_27.Vertices, Index=item_71, Wrap=True)

deccutmesh_30 = DeconstructCutMesh(TriangulatedMeshOrCutMesh=developcm3_6)  # -> Vertices, Faces, Edges
dist_11 = Distance(PointA=deccutmesh_13.Vertices, PointB=deccutmesh_30.Vertices)
lng_24 = ListLength(List=dist_11)
series_52 = Series(Start=0, Step=1, Count=lng_24)
series_53 = Series(Start=0, Step=1, Count=Slider(30, range=0..100))
avr_33 = Average(Input=dist_11)
sort_33 = SortList(Keys=dist_11, ValuesA=series_52)  # -> Keys, ValuesA
item_73 = ListItem(List=sort_33.Keys, Index=0, Wrap=True)  # -> Item1, Item
merge_32 = Merge(Data1=item_73.Item1, Data2=item_73.Item, Data3=avr_33)  # -> flatten(Result)
panel_54 = Panel(merge_32)

x_plus_one_21 = XPlusOne(NumberX=series_53)
x_plus_one_22 = XPlusOne(NumberX=series_49)
avr_34 = Average(Input=sort_31.Keys)
item_74 = ListItem(List=sort_31.Keys, Index=0, Wrap=True)  # -> Item1, Item
merge_33 = Merge(Data1=avr_34, Data2=item_74.Item1, Data3=item_74.Item)

neg_22 = Negative(Value=x_plus_one_21)
item_75 = ListItem(List=sort_33.ValuesA, Index=neg_22, Wrap=True)
item_76 = ListItem(List=deccutmesh_13.Vertices, Index=item_75, Wrap=True)

neg_23 = Negative(Value=x_plus_one_22)
item_77 = ListItem(List=sort_31.ValuesA, Index=neg_23, Wrap=True)
item_78 = ListItem(List=deccutmesh_28.Vertices, Index=item_77, Wrap=True)
panel_55 = Panel(merge_33)

cutmeshgcurvature_16 = CutMeshGCurvature(TriangulatedMeshOrCutMesh=developcm3_5)
abs_18 = Absolute(Value=cutmeshgcurvature_16)
lng_25 = ListLength(List=cutmeshgcurvature_16)
series_54 = Series(Start=0, Step=1, Count=lng_25)
series_55 = Series(Start=0, Step=1, Count=Slider(30, range=0..100))
sort_34 = SortList(Keys=abs_18, ValuesA=series_54)  # -> Keys, ValuesA

deccutmesh_31 = DeconstructCutMesh(TriangulatedMeshOrCutMesh=developcm3_5)  # -> Vertices, Faces, Edges
dist_12 = Distance(PointA=deccutmesh_13.Vertices, PointB=deccutmesh_31.Vertices)
lng_26 = ListLength(List=dist_12)
series_56 = Series(Start=0, Step=1, Count=lng_26)
series_57 = Series(Start=0, Step=1, Count=Slider(30, range=0..100))
avr_35 = Average(Input=dist_12)
sort_35 = SortList(Keys=dist_12, ValuesA=series_56)  # -> Keys, ValuesA
item_79 = ListItem(List=sort_35.Keys, Index=0, Wrap=True)  # -> Item1, Item
merge_34 = Merge(Data1=item_79.Item1, Data2=item_79.Item, Data3=avr_35)  # -> flatten(Result)
panel_56 = Panel(merge_34)

x_plus_one_23 = XPlusOne(NumberX=series_45)
x_plus_one_24 = XPlusOne(NumberX=series_57)
avr_36 = Average(Input=sort_29.Keys)
item_80 = ListItem(List=sort_29.Keys, Index=0, Wrap=True)  # -> Item1, Item
x_plus_one_25 = XPlusOne(NumberX=series_55)
merge_35 = Merge(Data1=avr_36, Data2=item_80.Item1, Data3=item_80.Item)
avr_37 = Average(Input=sort_34.Keys)
item_81 = ListItem(List=sort_34.Keys, Index=0, Wrap=True)  # -> Item1, Item
merge_36 = Merge(Data1=avr_37, Data2=item_81.Item1, Data3=item_81.Item)

neg_24 = Negative(Value=x_plus_one_23)
item_82 = ListItem(List=sort_29.ValuesA, Index=neg_24, Wrap=True)
panel_57 = Panel(merge_35)
item_83 = ListItem(List=deccutmesh_13.Vertices, Index=item_82, Wrap=True)

neg_25 = Negative(Value=x_plus_one_24)
item_84 = ListItem(List=sort_35.ValuesA, Index=neg_25, Wrap=True)
item_85 = ListItem(List=deccutmesh_13.Vertices, Index=item_84, Wrap=True)

neg_26 = Negative(Value=x_plus_one_25)
item_86 = ListItem(List=sort_34.ValuesA, Index=neg_26, Wrap=True)
item_87 = ListItem(List=deccutmesh_13.Vertices, Index=item_86, Wrap=True)
panel_58 = Panel(merge_36)

# ----
# Selfのみ
number_slider_32 = Slider(2000, range=0..10000)
developcm3_7 = DevelopCutMesh3(
    TriangulatedCutMesh=mesh_3,
    Iterations=number_slider_32,
    XyMirror=False,
    YzMirror=False,
    ZxMirror=False,
    OuterBoundaryCurves=meshedges_6.NakedE,
    Alpha=1)
deccutmesh_32 = DeconstructCutMesh(TriangulatedMeshOrCutMesh=developcm3_7)  # -> Vertices, Faces, Edges

netbff_6 = NetBFF(TriangulatedMeshOrCutMesh=developcm3_7)  # -> CutMesh, FeatureLinesPolylines
cutmeshedges_22 = CutMeshEdges(TriangulatedMeshOrCutMesh=developcm3_7)  # -> MeshAllEdges, MeshNakedEdges
netbfflength_2 = NetBFFLength(TriangulatedMeshOrCutMesh=developcm3_7, OuterBoundaryVertCount=-1)  # -> CutMesh, FeatureLinesPolylines
cutmeshedges_23 = CutMeshEdges(TriangulatedMeshOrCutMesh=netbfflength_2.CutMesh)  # -> MeshAllEdges, MeshNakedEdges
cutmeshedges_24 = CutMeshEdges(TriangulatedMeshOrCutMesh=netbff_6.CutMesh)  # -> MeshAllEdges, MeshNakedEdges
len_12 = Length(Curve=cutmeshedges_22.MeshAllEdges)
len_13 = Length(Curve=cutmeshedges_24.MeshAllEdges)
len_14 = Length(Curve=cutmeshedges_22.MeshAllEdges)
len_15 = Length(Curve=cutmeshedges_23.MeshAllEdges)
subtraction_6 = Subtraction(A=len_13, B=len_12)
subtraction_7 = Subtraction(A=len_15, B=len_14)
abs_19 = Absolute(Value=subtraction_6)
abs_20 = Absolute(Value=subtraction_7)
sort_36 = SortList(Keys=abs_19)  # -> Keys, ValuesA
avr_38 = Average(Input=abs_19)
sort_37 = SortList(Keys=abs_20)  # -> Keys, ValuesA
avr_39 = Average(Input=abs_20)
item_88 = ListItem(List=sort_36.Keys, Index=0, Wrap=True)  # -> Item1, Item
item_89 = ListItem(List=sort_37.Keys, Index=0, Wrap=True)  # -> Item1, Item
merge_37 = Merge(Data1=item_88.Item1, Data2=item_88.Item, Data3=avr_38)  # -> flatten(Result)
merge_38 = Merge(Data1=item_89.Item1, Data2=item_89.Item, Data3=avr_39)  # -> flatten(Result)
panel_59 = Panel(merge_37)
panel_60 = Panel(merge_38)

cutmeshgcurvature_17 = CutMeshGCurvature(TriangulatedMeshOrCutMesh=developcm3_7)
abs_21 = Absolute(Value=cutmeshgcurvature_17)
lng_27 = ListLength(List=cutmeshgcurvature_17)
series_58 = Series(Start=0, Step=1, Count=lng_27)
series_59 = Series(Start=0, Step=1, Count=Slider(30, range=0..100))
sort_38 = SortList(Keys=abs_21, ValuesA=series_58)  # -> Keys, ValuesA

deccutmesh_33 = DeconstructCutMesh(TriangulatedMeshOrCutMesh=developcm3_7)  # -> Vertices, Faces, Edges
dist_13 = Distance(PointA=deccutmesh_13.Vertices, PointB=deccutmesh_33.Vertices)
lng_28 = ListLength(List=dist_13)
series_60 = Series(Start=0, Step=1, Count=lng_28)
series_61 = Series(Start=0, Step=1, Count=Slider(30, range=0..100))
avr_40 = Average(Input=dist_13)
sort_39 = SortList(Keys=dist_13, ValuesA=series_60)  # -> Keys, ValuesA
item_90 = ListItem(List=sort_39.Keys, Index=0, Wrap=True)  # -> Item1, Item
merge_39 = Merge(Data1=item_90.Item1, Data2=item_90.Item, Data3=avr_40)  # -> flatten(Result)
panel_61 = Panel(merge_39)

x_plus_one_26 = XPlusOne(NumberX=series_61)
x_plus_one_27 = XPlusOne(NumberX=series_59)
avr_41 = Average(Input=sort_38.Keys)
item_91 = ListItem(List=sort_38.Keys, Index=0, Wrap=True)  # -> Item1, Item
merge_40 = Merge(Data1=avr_41, Data2=item_91.Item1, Data3=item_91.Item)

neg_27 = Negative(Value=x_plus_one_26)
item_92 = ListItem(List=sort_39.ValuesA, Index=neg_27, Wrap=True)
item_93 = ListItem(List=deccutmesh_13.Vertices, Index=item_92, Wrap=True)

neg_28 = Negative(Value=x_plus_one_27)
item_94 = ListItem(List=sort_38.ValuesA, Index=neg_28, Wrap=True)
item_95 = ListItem(List=deccutmesh_32.Vertices, Index=item_94, Wrap=True)
panel_62 = Panel(merge_40)
