# Grasshopper definition 奥村メッシュ.gh (Grasshopper 1.0.8)
# plug-ins: Pufferfish, Hagoromo, Weaverbird, NGon_RH8

crv = Curve([<curve referenced from the Rhino model> x1732])
wbweave = WeaverbirdsMeshFromLinesWeaveBack(Lines=crv, MaximumValence=4)
meshedges = MeshEdges(Mesh=wbweave)  # -> AllE, NakedE
join = JoinCurves(Curves=meshedges.NakedE, Preserve=False)
mbridgecm = MbridgeCM(TriangulatedMeshOrCutMesh=wbweave)
explode = Explode(Curve=join, Recursive=True)  # -> Segments, Vertices
number_slider = Slider(1000, range=0..1000)
panel = Panel(join)
_10º = PowerOf10(Value=Slider(3, range=-10..10))
_10º_2 = PowerOf10(Value=Slider(-1, range=-10..10))
_10º_3 = PowerOf10(Value=Slider(4, range=-10..10))
mesh = Mesh(<mesh referenced from the Rhino model>)
number_slider_2 = Slider(4, range=0..10)
mesh_2 = Mesh(<mesh referenced from the Rhino model>)
panel_2 = Panel("""1519
1529
1559
1514""")
crv_2 = Curve(<curve referenced from the Rhino model>)
developcgls = DevelopCGLS(
    TriangulatedCutMesh=mbridgecm,
    InnerIter=100,
    OuterIter=Slider(100, range=0..1000),
    XyMirror=False,
    YzMirror=False,
    ZxMirror=False,
    OuterBoundaryCurves=meshedges.NakedE,
    FixPointsCrv=meshedges.NakedE,
    EdgeW=_10º_2,
    SmoothW=_10º_3,
    DevW=_10º)  # disabled
number_slider_3 = Slider(1514, range=1500..1560)
mbridgecm_2 = MbridgeCM(TriangulatedMeshOrCutMesh=mesh_2)
number_slider_4 = Slider(1417, range=1400..1420)
cutmeshedges = CutMeshEdges(TriangulatedMeshOrCutMesh=developcgls)  # -> MeshAllEdges, MeshNakedEdges
number_slider_5 = Slider(1000, range=0..1000)
_10º_4 = PowerOf10(Value=Slider(-3, range=-4..10))
_10º_5 = PowerOf10(Value=Slider(4, range=0..10))
mbridgecm_3 = MbridgeCM(TriangulatedMeshOrCutMesh=mesh)
series = Series(Start=Slider(1001, range=0..10000), Step=1, Count=Slider(556, range=0..1000))
meshcutbylines = MeshCutWithCutLines(TriangulatedMeshOrCutMesh=mbridgecm_2, OpenCutLinesPolylines=crv_2)  # disabled
cutmeshedges_2 = CutMeshEdges(TriangulatedMeshOrCutMesh=developcgls)  # -> MeshAllEdges, MeshNakedEdges
meshedges_2 = MeshEdges(Mesh=mesh)  # -> AllE, NakedE
crv_3 = Curve(meshedges_2.AllE)
crv_4 = Curve(meshedges_2.NakedE)
_10º_6 = PowerOf10(Value=Slider(3, range=-10..10))
_10º_7 = PowerOf10(Value=Slider(-1, range=-10..10))
_10º_8 = PowerOf10(Value=Slider(4, range=-10..10))
panel_3 = Panel("""1417
1414""")
series_2 = Series(Start=_10º_5, Step="0", Count="6")  # -> flatten(Series)
item = ListItem(List=cutmeshedges.MeshAllEdges, Index=panel_2, Wrap=True)
checkobjective = CheckObjective(
    TriangulatedCutMesh=developcgls,
    XyMirror=False,
    YzMirror=False,
    ZxMirror=False,
    OuterBoundaryCurves=cutmeshedges_2.MeshNakedEdges)
panel_4 = Panel(checkobjective)
sortcutmesh = SortCutMesh(TriangulatedMeshOrCutMesh=meshcutbylines)
item_2 = ListItem(List=cutmeshedges.MeshAllEdges, Index=panel_3, Wrap=True)
developcgls_2 = DevelopCGLS(
    TriangulatedCutMesh=mbridgecm_3,
    InnerIter=100,
    OuterIter=Slider(100, range=0..1000),
    XyMirror=False,
    YzMirror=False,
    ZxMirror=False,
    OuterBoundaryCurves=crv_4,
    FixPointsCrv=crv_4,
    EdgeW=_10º_7,
    SmoothW=_10º_8,
    DevW=_10º_6)  # disabled
merge = Merge(Data1=_10º_4, Data2=series_2)
merge_2 = Merge(Data1=item, Data2=item_2)
meshcutbylines_2 = MeshCutWithCutLines(TriangulatedMeshOrCutMesh=developcgls, OpenCutLinesPolylines=item)
sortcutmesh_2 = SortCutMesh(TriangulatedMeshOrCutMesh=meshcutbylines_2)
meshcutbylines_3 = MeshCutWithCutLines(TriangulatedMeshOrCutMesh=developcgls, OpenCutLinesPolylines=merge_2)
netbff = NetBFF(TriangulatedMeshOrCutMesh=developcgls)  # -> CutMesh, FeatureLinesPolylines
panel_5 = Panel(merge)
netbfflength = NetBFFLength(TriangulatedMeshOrCutMesh=developcgls, OuterBoundaryVertCount="70")  # -> CutMesh, FeatureLinesPolylines
netlbfgs = NetLBFGS(TriangulatedMeshOrCutMesh=developcgls, HasHole="true", W0=1, W1=1, Switch=False)  # -> CutMesh, FeatureLinesPolylines
cutmeshedges_3 = CutMeshEdges(TriangulatedMeshOrCutMesh=sortcutmesh)  # -> MeshAllEdges, MeshNakedEdges
developcm5 = DevelopCutMesh5(
    TriangulatedCutMesh=mbridgecm_3,
    Iterations=Slider(100, range=0..1000),
    XyMirror=False,
    YzMirror=False,
    ZxMirror=False,
    OuterBoundaryCurves=meshedges_2.NakedE,
    Weight=merge)
cutmeshedges_4 = CutMeshEdges(TriangulatedMeshOrCutMesh=developcgls_2)  # -> MeshAllEdges, MeshNakedEdges
checkobjective_2 = CheckObjective(
    TriangulatedCutMesh=developcgls_2,
    XyMirror=False,
    YzMirror=False,
    ZxMirror=False,
    OuterBoundaryCurves=cutmeshedges_4.MeshNakedEdges)
panel_6 = Panel(checkobjective_2)
dividecutmesh = DivideCutMesh(TriangulatedMeshOrCutMesh=meshcutbylines_3)
cutmeshedges_5 = CutMeshEdges(TriangulatedMeshOrCutMesh=sortcutmesh_2)  # -> MeshAllEdges, MeshNakedEdges
lng = ListLength(List=cutmeshedges_5.MeshNakedEdges)  # -> flatten(Length)
netbff2 = NetBFF2(TriangulatedMeshOrCutMesh=developcgls, OuterBoundaryVertCount="70")  # -> CutMesh, FeatureLinesPolylines
sortcutmesh_3 = SortCutMesh(TriangulatedMeshOrCutMesh=dividecutmesh)
crv_5 = Curve(cutmeshedges_3.MeshNakedEdges)
item_3 = ListItem(List=sortcutmesh_3, Index=0, Wrap=True)  # -> flatten(Item), Item1
netbfflength_2 = NetBFFLength(TriangulatedMeshOrCutMesh=sortcutmesh_2, OuterBoundaryVertCount=lng)  # -> CutMesh, FeatureLinesPolylines
cutmeshedges_6 = CutMeshEdges(TriangulatedMeshOrCutMesh=item_3.Item)  # -> MeshAllEdges, MeshNakedEdges
lng_2 = ListLength(List=cutmeshedges_6.MeshNakedEdges)  # -> flatten(Length)
netbfflength_3 = NetBFFLength(TriangulatedMeshOrCutMesh=item_3.Item, OuterBoundaryVertCount=lng_2)  # -> CutMesh, FeatureLinesPolylines
mbridgecm_4 = MbridgeCM(TriangulatedMeshOrCutMesh=netbfflength_2.CutMesh)
cutmeshedges_7 = CutMeshEdges(TriangulatedMeshOrCutMesh=item_3.Item1)  # -> MeshAllEdges, MeshNakedEdges
lng_3 = ListLength(List=cutmeshedges_7.MeshNakedEdges)  # -> flatten(Length)
netbfflength_4 = NetBFFLength(TriangulatedMeshOrCutMesh=item_3.Item1, OuterBoundaryVertCount=lng_3)  # -> CutMesh, FeatureLinesPolylines
cutmeshedges_8 = CutMeshEdges(TriangulatedMeshOrCutMesh=netbfflength_3.CutMesh)  # -> MeshAllEdges, MeshNakedEdges
mbridgecm_5 = MbridgeCM(TriangulatedMeshOrCutMesh=netbfflength_3.CutMesh)
meshedges_3 = MeshEdges(Mesh=mbridgecm_4)  # -> AllE, NakedE
cutmeshedges_9 = CutMeshEdges(TriangulatedMeshOrCutMesh=netbfflength_4.CutMesh)  # -> MeshAllEdges, MeshNakedEdges
len = Length(Curve=cutmeshedges_6.MeshAllEdges)
X = UnitX(Factor=Slider(149, range=0..1000))
mbridgecm_6 = MbridgeCM(TriangulatedMeshOrCutMesh=netbfflength_4.CutMesh)
len_2 = Length(Curve=cutmeshedges_8.MeshAllEdges)
subtraction = Subtraction(A=len, B=len_2)
len_3 = Length(Curve=cutmeshedges_7.MeshAllEdges)
X_2 = UnitX(Factor=Slider(90, range=0..1000))
len_4 = Length(Curve=cutmeshedges_9.MeshAllEdges)
subtraction_2 = Subtraction(A=len_3, B=len_4)
move = Move(Geometry=mbridgecm_5, Motion=X)  # -> Geometry, Transform
crv_6 = Curve(meshedges_3.NakedE)
sqr = Square(Value=subtraction)
sqr_2 = Square(Value=subtraction_2)
move_2 = Move(Geometry=mbridgecm_6, Motion=X_2)  # -> Geometry, Transform
deccutmesh = DeconstructCutMesh(TriangulatedMeshOrCutMesh=sortcutmesh)  # -> Vertices, Faces, Edges
avr = Average(Input=sqr)
avr_2 = Average(Input=sqr_2)
panel_7 = Panel(avr_2)
panel_8 = Panel(avr)
netbff_2 = NetBFF(TriangulatedMeshOrCutMesh=sortcutmesh)  # -> CutMesh, FeatureLinesPolylines
netbfflength_5 = NetBFFLength(TriangulatedMeshOrCutMesh=sortcutmesh, OuterBoundaryVertCount=-1)  # -> CutMesh, FeatureLinesPolylines

# ----
# 長さの最適化まで入れたら長さのずれが0.1倍になった
cutmeshedges_10 = CutMeshEdges(TriangulatedMeshOrCutMesh=sortcutmesh)  # -> MeshAllEdges, MeshNakedEdges
cutmeshedges_11 = CutMeshEdges(TriangulatedMeshOrCutMesh=netbfflength_5.CutMesh)  # -> MeshAllEdges, MeshNakedEdges
cutmeshedges_12 = CutMeshEdges(TriangulatedMeshOrCutMesh=netbff_2.CutMesh)  # -> MeshAllEdges, MeshNakedEdges
len_5 = Length(Curve=cutmeshedges_10.MeshAllEdges)
len_6 = Length(Curve=cutmeshedges_12.MeshAllEdges)
len_7 = Length(Curve=cutmeshedges_10.MeshAllEdges)
len_8 = Length(Curve=cutmeshedges_11.MeshAllEdges)
subtraction_3 = Subtraction(A=len_6, B=len_5)
subtraction_4 = Subtraction(A=len_8, B=len_7)
abs = Absolute(Value=subtraction_3)
abs_2 = Absolute(Value=subtraction_4)
sort = SortList(Keys=abs)  # -> Keys, ValuesA
avr_3 = Average(Input=abs)
sort_2 = SortList(Keys=abs_2)  # -> Keys, ValuesA
avr_4 = Average(Input=abs_2)
item_4 = ListItem(List=sort.Keys, Index=0, Wrap=True)  # -> Item1, Item
item_5 = ListItem(List=sort_2.Keys, Index=0, Wrap=True)  # -> Item1, Item
merge_3 = Merge(Data1=item_4.Item1, Data2=item_4.Item, Data3=avr_3)  # -> flatten(Result)
merge_4 = Merge(Data1=item_5.Item1, Data2=item_5.Item, Data3=avr_4)  # -> flatten(Result)
panel_9 = Panel(merge_3)
panel_10 = Panel(merge_4)

# ----
# Selfのみ
number_slider_6 = Slider(190, range=0..10000)
developcm3 = DevelopCutMesh3(
    TriangulatedCutMesh=sortcutmesh,
    Iterations=number_slider_6,
    XyMirror=False,
    YzMirror=False,
    ZxMirror=False,
    OuterBoundaryCurves=crv_5,
    Alpha=Slider(0.1, range=0..0.1))
deccutmesh_2 = DeconstructCutMesh(TriangulatedMeshOrCutMesh=developcm3)  # -> Vertices, Faces, Edges

mbridgecm_7 = MbridgeCM(TriangulatedMeshOrCutMesh=developcm3)
preview = CustomPreview(
    Geometry=mbridgecm_7,
    Material={diffuse=RGB(221, 160, 221), emission=RGB(66, 48, 66), shine=0.5, specular=RGB(255, 255, 255), transparency=0})
sortcutmesh_4 = SortCutMesh(TriangulatedMeshOrCutMesh=developcm3)
cutmeshedges_13 = CutMeshEdges(TriangulatedMeshOrCutMesh=sortcutmesh_4)  # -> MeshAllEdges, MeshNakedEdges
netbff_3 = NetBFF(TriangulatedMeshOrCutMesh=developcm3)  # -> CutMesh, FeatureLinesPolylines
netbfflength_6 = NetBFFLength(TriangulatedMeshOrCutMesh=developcm3, OuterBoundaryVertCount=-1)  # -> CutMesh, FeatureLinesPolylines

# ----
# 長さの最適化まで入れたら長さのずれが0.1倍になった
cutmeshedges_14 = CutMeshEdges(TriangulatedMeshOrCutMesh=developcm3)  # -> MeshAllEdges, MeshNakedEdges
cutmeshedges_15 = CutMeshEdges(TriangulatedMeshOrCutMesh=netbfflength_6.CutMesh)  # -> MeshAllEdges, MeshNakedEdges
cutmeshedges_16 = CutMeshEdges(TriangulatedMeshOrCutMesh=netbff_3.CutMesh)  # -> MeshAllEdges, MeshNakedEdges
len_9 = Length(Curve=cutmeshedges_14.MeshAllEdges)
len_10 = Length(Curve=cutmeshedges_16.MeshAllEdges)
len_11 = Length(Curve=cutmeshedges_14.MeshAllEdges)
len_12 = Length(Curve=cutmeshedges_15.MeshAllEdges)
subtraction_5 = Subtraction(A=len_10, B=len_9)
subtraction_6 = Subtraction(A=len_12, B=len_11)
abs_3 = Absolute(Value=subtraction_5)
abs_4 = Absolute(Value=subtraction_6)
sort_3 = SortList(Keys=abs_3)  # -> Keys, ValuesA
avr_5 = Average(Input=abs_3)
sort_4 = SortList(Keys=abs_4)  # -> Keys, ValuesA
avr_6 = Average(Input=abs_4)
item_6 = ListItem(List=sort_3.Keys, Index=0, Wrap=True)  # -> Item1, Item
item_7 = ListItem(List=sort_4.Keys, Index=0, Wrap=True)  # -> Item1, Item
merge_5 = Merge(Data1=item_6.Item1, Data2=item_6.Item, Data3=avr_5)  # -> flatten(Result)
merge_6 = Merge(Data1=item_7.Item1, Data2=item_7.Item, Data3=avr_6)  # -> flatten(Result)
panel_11 = Panel(merge_5)
panel_12 = Panel(merge_6)

cruling = CheckRuling(TriangulatedDevelopableCutMesh=sortcutmesh_4, Lines=cutmeshedges_13.MeshNakedEdges)
panel_13 = Panel(cruling)

develop = DevelopMesh()  # -> ModifiedMesh, A
sortcutmesh_5 = SortCutMesh(TriangulatedMeshOrCutMesh=develop.ModifiedMesh)
deccutmesh_3 = DeconstructCutMesh(TriangulatedMeshOrCutMesh=sortcutmesh_5)  # -> Vertices, Faces, Edges

cutmeshgcurvature = CutMeshGCurvature(TriangulatedMeshOrCutMesh=sortcutmesh)
abs_5 = Absolute(Value=cutmeshgcurvature)
lng_4 = ListLength(List=cutmeshgcurvature)
series_3 = Series(Start=0, Step=1, Count=lng_4)
series_4 = Series(Start=0, Step=1, Count=Slider(30, range=0..100))
sort_5 = SortList(Keys=abs_5, ValuesA=series_3)  # -> Keys, ValuesA

x_plus_one = XPlusOne(NumberX=series_4)
avr_7 = Average(Input=sort_5.Keys)
item_8 = ListItem(List=sort_5.Keys, Index=0, Wrap=True)  # -> Item1, Item
merge_7 = Merge(Data1=avr_7, Data2=item_8.Item1, Data3=item_8.Item)

neg = Negative(Value=x_plus_one)
item_9 = ListItem(List=sort_5.ValuesA, Index=neg, Wrap=True)
item_10 = ListItem(List=deccutmesh.Vertices, Index=item_9, Wrap=True)
panel_14 = Panel(merge_7)

cutmeshgcurvature_2 = CutMeshGCurvature(TriangulatedMeshOrCutMesh=sortcutmesh_5)
lng_5 = ListLength(List=cutmeshgcurvature_2)
abs_6 = Absolute(Value=cutmeshgcurvature_2)
series_5 = Series(Start=0, Step=1, Count=lng_5)
series_6 = Series(Start=0, Step=1, Count=10)
sort_6 = SortList(Keys=abs_6, ValuesA=series_5)  # -> Keys, ValuesA

x_plus_one_2 = XPlusOne(NumberX=series_6)
avr_8 = Average(Input=sort_6.Keys)
item_11 = ListItem(List=sort_6.Keys, Index=0, Wrap=True)  # -> Item1, Item
merge_8 = Merge(Data1=avr_8, Data2=item_11.Item1, Data3=item_11.Item)

neg_2 = Negative(Value=x_plus_one_2)
item_12 = ListItem(List=sort_6.ValuesA, Index=neg_2, Wrap=True)
panel_15 = Panel(merge_8)
item_13 = ListItem(List=deccutmesh_3.Vertices, Index=item_12, Wrap=True)

deccutmesh_4 = DeconstructCutMesh(TriangulatedMeshOrCutMesh=developcm3)  # -> Vertices, Faces, Edges
dist = Distance(PointB=deccutmesh_4.Vertices)
lng_6 = ListLength(List=dist)
series_7 = Series(Start=0, Step=1, Count=lng_6)
series_8 = Series(Start=0, Step=1, Count=Slider(30, range=0..100))
avr_9 = Average(Input=dist)
sort_7 = SortList(Keys=dist, ValuesA=series_7)  # -> Keys, ValuesA
item_14 = ListItem(List=sort_7.Keys, Index=0, Wrap=True)  # -> Item1, Item
merge_9 = Merge(Data1=item_14.Item1, Data2=item_14.Item, Data3=avr_9)  # -> flatten(Result)
panel_16 = Panel(merge_9)

cutmeshgcurvature_3 = CutMeshGCurvature(TriangulatedMeshOrCutMesh=developcm3)
abs_7 = Absolute(Value=cutmeshgcurvature_3)
lng_7 = ListLength(List=cutmeshgcurvature_3)
series_9 = Series(Start=0, Step=1, Count=lng_7)
series_10 = Series(Start=0, Step=1, Count=Slider(30, range=0..100))
sort_8 = SortList(Keys=abs_7, ValuesA=series_9)  # -> Keys, ValuesA

x_plus_one_3 = XPlusOne(NumberX=series_8)
x_plus_one_4 = XPlusOne(NumberX=series_10)
avr_10 = Average(Input=sort_8.Keys)
item_15 = ListItem(List=sort_8.Keys, Index=0, Wrap=True)  # -> Item1, Item
merge_10 = Merge(Data1=avr_10, Data2=item_15.Item1, Data3=item_15.Item)

panel_17 = Panel(merge_10)
neg_3 = Negative(Value=x_plus_one_4)
item_16 = ListItem(List=sort_8.ValuesA, Index=neg_3, Wrap=True)
item_17 = ListItem(List=deccutmesh_2.Vertices, Index=item_16, Wrap=True)

neg_4 = Negative(Value=x_plus_one_3)
item_18 = ListItem(List=sort_7.ValuesA, Index=neg_4, Wrap=True)
item_19 = ListItem(Index=item_18, Wrap=True)

deccutmesh_5 = DeconstructCutMesh()  # -> Vertices, Faces, Edges
dist_2 = Distance(PointB=deccutmesh_5.Vertices)
lng_8 = ListLength(List=dist_2)
series_11 = Series(Start=0, Step=1, Count=lng_8)
series_12 = Series(Start=0, Step=1, Count=Slider(30, range=0..100))
sort_9 = SortList(Keys=dist_2, ValuesA=series_11)  # -> Keys, ValuesA
item_20 = ListItem(List=sort_9.Keys, Index=0, Wrap=True)  # -> Item1, Item
merge_11 = Merge(Data1=item_20.Item1, Data2=item_20.Item)  # -> flatten(Result)
panel_18 = Panel(merge_11)

# ----
# ハイブリッド
x_plus_one_5 = XPlusOne(NumberX=series_12)

neg_5 = Negative(Value=x_plus_one_5)
item_21 = ListItem(List=sort_9.ValuesA, Index=neg_5, Wrap=True)
item_22 = ListItem(Index=item_21, Wrap=True)
